# Grasshopper definition 3D_Hilbert_Curve.gh (Grasshopper 1.0.7)

# N.B.: this definition uses the following plugins:
# - Anemone by Mateusz Zwierzycki >>
# https://www.food4rhino.com/app/anemone
# - Mesh Pipe (optional) by Mateusz Zwierzycki
# https://www.grasshopper3d.com/forum/topics/mesh-pipe
number_slider = Slider(0.214, range=0..2)
button = Button()
mesh = Mesh(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)
demesh = DeconstructMesh(Mesh=mesh)  # -> Vertices, Faces, Colours, Normals
panel = Panel("""0
4
7
3
2
6
5
1""")
item = ListItem(List=demesh.Vertices, Index=panel, Wrap=True)
item_2 = ListItem(List=demesh.Vertices, Index=0, Wrap=True)  # -> Item, Item1, Item2, Item3, Item4, Item5, Item6, Item7
scale = Scale(Geometry=graft(mesh), Center=item, Factor=number_slider)  # -> simplify(Geometry), Transform

# ----
# 3D_Hilbert_Curve
# 
# This definigtion generates a 3D Hilbert curve, a continuous fractal space-filling curve.
# 
# code by Andrea Graziano
# v 0.1
# 
# © Co-de-iT 2019 _ Creative Commons Attribution-NonCommercial-ShareAlike 4.0 International License
# References:
# http://ariwatch.com/VS/Algorithms/Hilbert3D.htm
image = ImageSampler(Filter="Colour", Interpolate=False, Umax=1, Umin=0, Vmax=1, Vmin=0, Wrap=1)
image_2 = ImageSampler(Filter="Colour", Interpolate=False, Umax=1, Umin=0, Vmax=1, Vmin=0, Wrap=1)

vec2pt = Vector2Pt(PointA=item_2.Item, PointB=item_2.Item6, Unitize=False)  # -> Vector, Length
vec2pt_2 = Vector2Pt(PointA=item_2.Item, PointB=item_2.Item1, Unitize=False)  # -> Vector, Length
vec2pt_3 = Vector2Pt(PointA=item_2.Item1, PointB=item_2.Item7, Unitize=False)  # -> Vector, Length
panel_2 = Panel("""-120
120
120
180
180
-120
-120
120""")
merge = Merge(
    Data1=vec2pt.Vector,
    Data2=vec2pt.Vector,
    Data3=vec2pt.Vector,
    Data4=vec2pt_2.Vector,
    Data5=vec2pt_2.Vector,
    Data6=vec2pt_3.Vector,
    Data7=vec2pt_3.Vector,
    Data8=vec2pt_3.Vector)
rot3d = Rotate3D(Geometry=scale.Geometry, Angle=degrees(panel_2), Center=Point(0, 0, 0), Axis=merge)  # -> flatten(Geometry), Transform
demesh_2 = DeconstructMesh(Mesh=rot3d.Geometry)  # -> Vertices, Faces, Colours, Normals
faceb = FaceBoundaries()
image_3 = ImageSampler(Filter="Colour", Interpolate=False, Umax=1, Umin=0, Vmax=1, Vmin=0, Wrap=1)
preview = CustomPreview(Geometry=faceb, Material=ColourSwatch(SwatchColor=RGB(255, 255, 255)))
avr = Average(Input=demesh_2.Vertices)
scale_2 = Scale(Geometry=demesh_2.Vertices, Center=avr, Factor=0.5)  # -> Geometry, Transform
number_slider_2 = Slider(4, range=0..10)
item_3 = ListItem(List=scale_2.Geometry, Index=panel, Wrap=True)
expression = Expression(Expression="x+1")
pline = PolyLine(Vertices=flatten(item_3), Closed=False)
division = Division(A=Slider(0.3, range=0..1), B=expression)
rad = Radians(Degrees=Slider(45, range=0..100))
mcol = MeshColours(Mesh=pline, Colours=ColourSwatch(SwatchColor=RGB(255, 255, 255)))
preview_2 = CustomPreview(Geometry=mcol, Material=ColourSwatch(SwatchColor=RGB(0, 0, 0)))  # disabled
