# Grasshopper definition Attractor 1.gh (Grasshopper 0.9.61)

# ---- group: Grid Group
rec = Rectangle({Plane=PlaneXY(226.8986671, -42.37039893, 0), Size=Domain2(u=0..25.87505112, v=0..10.24782423)})
size = Slider(18.47, range=0..100)
pcen = PolygonCenter(Polyline=rec)  # -> CenterV, CenterE
scale = Scale(Geometry=rec, Center=pcen.CenterV, Factor=size)  # -> Geometry, Transform
sdivide = DivideSurface(Surface=scale.Geometry, UCount=10, VCount=10)  # -> Points, Normals, Parameters
pt = Point(simplify(graft(sdivide.Points)))

# ---- group: Attractor Group 2
md_slider = MDSlider(
    slider_value=Point(0.5315239139, 0.2279261147, 0.5),
    SliderMode=0,
    x_domain=Domain(0, 1),
    y_domain=Domain(0, 1),
    z_domain=Domain(0, 1))
vert = Slider(130.55, range=0..500)
drec = DeconstuctRectangle(Rectangle=scale.Geometry)  # -> BasePlane, XInterval, YInterval
devec = DeconstructVector(Vector=md_slider)  # -> XComponent, YComponent, ZComponent
neg = Negative(Value=vert)
remap = RemapNumbers(Value=devec.XComponent, Source=Domain(0, 1), Target=drec.XInterval)
remap_2 = RemapNumbers(Value=devec.YComponent, Source=Domain(0, 1), Target=drec.YInterval)
vec = VectorXYZ(XComponent=remap, YComponent=remap_2, ZComponent=neg)  # -> Vector, Length
move = Move(Geometry=drec.BasePlane, Motion=vec.Vector)  # -> Geometry, Transform
attractor = Point(move.Geometry)
dist = Distance(PointA=pt, PointB=attractor)

# ---- group: Attractor Group 1
md_slider_2 = MDSlider(
    slider_value=Point(0.6920731707, 0.3673780488, 0.5),
    SliderMode=0,
    x_domain=Domain(0, 1),
    y_domain=Domain(0, 1),
    z_domain=Domain(0, 1))
vert_2 = Slider(227.27, range=0..500)
devec_2 = DeconstructVector(Vector=md_slider_2)  # -> XComponent, YComponent, ZComponent
drec_2 = DeconstuctRectangle(Rectangle=scale.Geometry)  # -> BasePlane, XInterval, YInterval
neg_2 = Negative(Value=vert_2)
remap_3 = RemapNumbers(Value=devec_2.XComponent, Source=Domain(0, 1), Target=drec_2.XInterval)
remap_4 = RemapNumbers(Value=devec_2.YComponent, Source=Domain(0, 1), Target=drec_2.YInterval)
vec_2 = VectorXYZ(XComponent=remap_3, YComponent=remap_4, ZComponent=neg_2)  # -> Vector, Length
move_2 = Move(Geometry=drec_2.BasePlane, Motion=vec_2.Vector)  # -> Geometry, Transform
attractor_2 = Point(move_2.Geometry)
dist_2 = Distance(PointA=pt, PointB=attractor_2)

# ---- group: Mapper 1
max_domain = Slider(600, range=0..1000)
dom = ConstructDomain(DomainStart=0, DomainEnd=10)
dom_2 = ConstructDomain(DomainStart=-0.8, DomainEnd=0.8)
dom_3 = ConstructDomain(DomainStart=0, DomainEnd=1)
dom_4 = ConstructDomain(DomainStart=0, DomainEnd=max_domain)
rotate = Slider(0.56, range=-0.8..0.8)
shear = Slider(4.9, range=0..10)
push = Slider(0.494, range=0..1)
remap_5 = RemapNumbers(Value=dist_2, Source=dom_4, Target=dom)
remap_6 = RemapNumbers(Value=dist_2, Source=dom_4, Target=dom_2)
remap_7 = RemapNumbers(Value=dist_2, Source=dom_4, Target=dom_3)
filter = StreamFilter(Gate="1", Stream0=shear, Stream1=remap_5)
filter_2 = StreamFilter(Gate="1", Stream0=push, Stream1=remap_7)
filter_3 = StreamFilter(Gate="1", Stream0=rotate, Stream1=remap_6)

# ---- group: Mapper 2
max_domain_2 = Slider(236, range=0..1000)
rise = Slider(4.66, range=0..10)
dom_5 = ConstructDomain(DomainStart=-0.8, DomainEnd=10)
dom_6 = ConstructDomain(DomainStart=0, DomainEnd=max_domain_2)
remap_8 = RemapNumbers(Value=dist, Source=dom_6, Target=dom_5)
filter_4 = StreamFilter(Gate="1", Stream0=rise, Stream1=remap_8)

# ----
panel = Panel(dist_2)
number_slider = Slider(24, range=0..100)
pts_in = Point(simplify(pt))

# ---- group: Element Net
rectangle = Rectangle(Plane=pts_in, XSize=number_slider, YSize=Slider(8, range=0..10), Radius=0)  # -> Rectangle, Length
multiplication = Multiplication(A=number_slider, B=filter_2)
xz = XZPlane(Origin=pts_in)
cp = ControlPoints(Curve=rectangle.Rectangle)  # -> Points, Weights, Knots
X = UnitX(Factor=filter)
item = ListItem(List=cp.Points, Index="3", Wrap=True)  # -> simplify(Item)
move_3 = Move(Geometry=item, Motion=X)  # -> Geometry, Transform
shear_2 = Shear(Geometry=rectangle.Rectangle, Base=xz, Grip=item, Target=move_3.Geometry)  # -> Geometry, Transform
explode = Explode(Curve=shear_2.Geometry, Recursive=True)  # -> Segments, Vertices
item_2 = ListItem(List=explode.Segments, Index="3", Wrap=True)
line = Line(item_2)
X_2 = UnitX(Factor=multiplication)
move_4 = Move(Geometry=line, Motion=X_2)  # -> Geometry, Transform
X_3 = UnitX(Factor="4")
Y = UnitY(Factor=filter_3)
end = EndPoints(Curve=move_4.Geometry)  # -> Start, End
addition = Addition(A=X_3, B=Y)
rotate_2 = Rotate(Geometry=move_4.Geometry, Center=end.End, From=Vector(1, 0, 0), To=addition)  # -> Geometry, Transform
item_3 = ListItem(List=explode.Vertices, Index="0", Wrap=True)
item_4 = ListItem(List=explode.Vertices, Index="3", Wrap=True)
item_5 = ListItem(List=explode.Vertices, Index="2", Wrap=True)
item_6 = ListItem(List=explode.Vertices, Index="1", Wrap=True)
ext = ExtendCurve(Curve=rotate_2.Geometry, Type=0, Start="5", End="1")
bottom_low = Point(item_3)
ccx = CurveCurve(CurveA=shear_2.Geometry, CurveB=ext)  # -> Points, ParamsA, ParamsB
top_low = Point(item_4)
bottom_high = Point(item_6)
top_high = Point(item_5)
Z = UnitZ(Factor=filter_4)
item_7 = ListItem(List=ccx.Points, Index="0", Wrap=True)
item_8 = ListItem(List=ccx.Points, Index="3", Wrap=True)
bottom_mid = Point(item_7)
top_mid = Point(item_8)
ln = Line(StartPoint=bottom_high, EndPoint=top_high)
ln_2 = Line(StartPoint=bottom_mid, EndPoint=top_mid)
ln_3 = Line(StartPoint=bottom_low, EndPoint=top_low)  # -> simplify(Line)
move_5 = Move(Geometry=ln_2, Motion=Z)  # -> simplify(Geometry), Transform
move_6 = Move(Geometry=ln, Motion=Z)  # -> simplify(Geometry), Transform

# ----
line_2 = Line([move_5.Geometry, move_6.Geometry])
line_3 = Line([ln_3, move_5.Geometry])

# ---- group: Element Net (continued)
loft = Loft(Curves=line_2, Options={Adjust=False, Closed=False, LoftEnds=0, LoftSimp=0, LoftType=0, Rebuild=10, Refit=0.01})
loft_2 = Loft(Curves=line_3, Options={Adjust=False, Closed=False, LoftEnds=0, LoftSimp=0, LoftType=0, Rebuild=10, Refit=0.01})
join = BrepJoin(Breps=[loft_2, loft])  # -> Breps, Closed
