# Grasshopper definition Bloch Fractal Pattern.gh (Grasshopper 1.0.7)

line = Line(Line((8, 9, 0), (18, 21, 0)))
rad = Radians(Degrees=Slider(75, range=0..90))
rad_2 = Radians(Degrees=Slider(75, range=0..180))
crv = Curve(line)
vb = VBScript(x=Slider(3, range=1..14), c=crv, t=rad_2, k=Slider(0.713, range=0..1), y=rad)  # -> out, A; inputs c: Line
# ---------- vb: VB usings ----------
Imports System.IO
Imports System.Linq
Imports System.Data
Imports System.Drawing
Imports System.Reflection
Imports System.Windows.Forms
Imports System.Xml
Imports System.Xml.Linq
Imports Microsoft.VisualBasic
Imports System.Runtime.InteropServices

Imports Rhino.DocObjects
Imports Rhino.Collections
Imports GH_IO
Imports GH_IO.Serialization
# ---------- vb: VB ----------
    Dim i,j As Int32
    Dim d(15,65536) As Line
    Dim temppoint As Point3d
    Dim tempdirection1, tempdirection2 As Vector3d
    Dim tempbranch1, tempbranch2 As Line
    Dim tempdist As Double
    Dim vector As New Vector3d(0, 0, 1)
    Dim result As New List (Of Line)
    d(0, 0) = c

    For i = 0 To x
      For j = 0 To (2 ^ i) - 1
        temppoint = d(i, j).To
        tempdirection1 = d(i, j).Direction
        tempdirection2 = d(i, j).Direction
        tempdirection1.Rotate(t, vector)
        tempdirection2.Rotate(-y, vector)
        tempdist = d(i, j).Length * k
        tempbranch1 = New Line(temppoint, tempdirection1, tempdist)
        tempbranch2 = New Line(temppoint, tempdirection2, tempdist)
        d(i + 1, j * 2) = tempbranch1
        d(i + 1, (j * 2) + 1) = tempbranch2
        result.Add(tempbranch1)
        result.Add(tempbranch2)
      Next
    Next
    A = result
# ---------- end vb ----------
line_2 = Line(Line((44.38949296, 18.52724461, 0), (11.66598023, 46.39036966, 0)))
crv_2 = Curve(vb.A)
rotax = RotateAxis(Geometry=crv_2, Angle=degrees(Slider(90, range=0..1000)), Axis=line_2)  # -> Geometry, Transform
box = Box({Plane=PlaneXY(18.89374003, 62.01511449, 0), X=Domain(0, 10.59958755), Y=Domain(0, 1.634141262), Z=Domain(0, 8.682422483)})
arrbox = BoxArray(Geometry=crv_2, Cell=box, XCount=Slider(1, range=0..10), YCount=Slider(1, range=0..10), ZCount=Slider(5, range=0..10))  # -> Geometry, Transform
mirror = Mirror(Geometry=arrbox.Geometry, Plane=box)  # -> Geometry, Transform
rotate = RotateDirection(Geometry=mirror.Geometry, Center=Point(0, 0, 0), From=Vector(1, 0, 0), To=Vector(0, 1, 0))  # -> Geometry, Transform
rotate_2 = RotateDirection(Geometry=rotate.Geometry, Center=Point(0, 0, 0), From=Vector(1, 0, 0), To=Vector(0, 1, 0))  # -> Geometry, Transform
rotate_3 = RotateDirection(Geometry=rotate_2.Geometry, Center=Point(0, 0, 0), From=Vector(1, 0, 0), To=Vector(0, 1, 0))  # -> Geometry, Transform
merge = Merge(Data1=rotate.Geometry, Data2=rotate_2.Geometry, Data3=rotate_3.Geometry, Data4=mirror.Geometry)
Y = UnitY(Factor=Slider(5, range=0..10))
Z = UnitZ(Factor=Slider(8, range=0..10))
X = UnitX(Factor=Slider(5, range=0..10))
vec = Vector([Z, X, Y])
