# Grasshopper definition Fara1_fins.gh (Grasshopper 1.0.7)

number_slider = Slider(17, range=0..100)
number_slider_2 = Slider(4, range=0..100)
range = Range(Domain=Domain(0, 1), Steps=expr("x-1", number_slider_2))
series = Series(Start=Slider(0, range=0..100), Step=number_slider, Count=number_slider_2)
polygon = Polygon(
    Plane=PlaneXY(0, 0, 0),
    Radius=Slider(6, range=0..100),
    Segments=Slider(3, range=0..100),
    FilletRadius=Slider(2, range=0..100))  # -> Polygon, Length
Z = UnitZ(Factor=series)
graph = GraphMapper(range, x0=0, x1=1, y0=0, y1=1, container_name="Sine", Equation_px=[0, 0.4738447666], Equation_py=[0, 0.593868494])
move = Move(Geometry=polygon.Polygon, Motion=Z)  # -> Geometry, Transform
dom = ConstructDomain(DomainStart=Slider(4, range=0..100), DomainEnd=Slider(4, range=0..100))
cp = ControlPoints(Curve=move.Geometry)  # -> Points, Weights, Knots
bnd = Bounds(Numbers=graph)
avr = Average(Input=cp.Points)  # -> flatten(ArithmeticMean)
remap = RemapNumbers(Value=graph, Source=bnd, Target=dom)  # -> Mapped, Clipped
scale_nu = ScaleNU(Geometry=move.Geometry, Plane=avr, ScaleX=remap.Mapped, ScaleY=remap.Mapped, ScaleZ=1)  # -> Geometry, Transform
series_2 = Series(Start=0, Step=Slider(29, range=0..100), Count=number_slider)
rotate = Rotate(Geometry=scale_nu.Geometry, Angle=degrees(series_2), Plane=PlaneXY(0, 0, 0))  # -> Geometry, Transform
Z_2 = UnitZ(Factor=Slider(7, range=0..10))
extr = Extrude(Base=rotate.Geometry, Direction=Z_2)
Z_3 = UnitZ(Factor=Slider(0, range=0..10))
move_2 = Move(Geometry=rotate.Geometry, Motion=Z_3)  # -> Geometry, Transform
cap = CapHoles(Brep=extr)
divide = DivideCurve(Curve=move_2.Geometry, Count=Slider(50, range=0..100), Kinks=False)  # -> Points, Tangents, Parameters
flip = FlipMatrix(Data=divide.Points)
item = ListItem(List=avr, Index="2", Wrap=True)
intcrv_t = InterpolateT(Vertices=flip, TangentStart=Vector(0, 0, 0), TangentEnd=Vector(0, 0, 0), KnotStyle=1)  # -> Curve, Length, Domain
ext = ExtendCurve(Curve=intcrv_t.Curve, Type=0, Start=Z_3, End=Z_3)
end = EndPoints(Curve=ext)  # -> flatten(Start), flatten(End)
curvepoint = PointOnCurve(ext, parameter=0.203)
intcrv = Interpolate(Vertices=end.End, Degree=3, Periodic=invert(False), KnotStyle=1)  # -> Curve, Length, Domain
intcrv_2 = Interpolate(Vertices=end.Start, Degree=3, Periodic=False, KnotStyle=1)  # -> Curve, Length, Domain
vec2pt = Vector2Pt(PointA=item, PointB=curvepoint, Unitize=True)  # -> Vector, Length
multiplication = Multiplication(A=vec2pt.Vector, B=Slider(1.94, range=0..10))
move_3 = Move(Geometry=ext, Motion=multiplication)  # -> Geometry, Transform
loft = Loft(
    Curves=[move_3.Geometry, ext],
    Options={Adjust=False, Closed=False, LoftEnds=0, LoftSimp=0, LoftType=0, Rebuild=10, Refit=0.01})
