# Grasshopper definition Fara2.gh (Grasshopper 1.0.7)

number_slider = Slider(41, range=0..100)
series = Series(Start=Slider(0, range=0..100), Step=Slider(1, range=0..100), Count=number_slider)
range = Range(Domain=number_slider, Steps=expr("x-1", 10))
polygon = Polygon(
    Plane=PlaneXY(0, 0, 0),
    Radius=Slider(5, range=0..100),
    Segments=Slider(3.176, range=0..100),
    FilletRadius=Slider(1, range=0..100))  # -> Polygon, Length
Z = UnitZ(Factor=series)
graph = GraphMapper(range, x0=0, x1=1, y0=0, y1=1, container_name="Sine", Equation_px=[0, 0.2617218494], Equation_py=[0, 0.8861893415])
move = Move(Geometry=polygon.Polygon, Motion=Z)  # -> Geometry, Transform
cp = ControlPoints(Curve=move.Geometry)  # -> Points, Weights, Knots
bnd = Bounds(Numbers=graph)
dom = ConstructDomain(DomainStart=Slider(0, range=0..100), DomainEnd=Slider(4, range=0..100))
remap = RemapNumbers(Value=graph, Source=bnd, Target=dom)  # -> Mapped, Clipped
avr = Average(Input=cp.Points)  # -> flatten(ArithmeticMean)
scale_nu = ScaleNU(Geometry=move.Geometry, Plane=avr, ScaleX=remap.Mapped, ScaleY=remap.Mapped, ScaleZ=1)  # -> Geometry, Transform
series_2 = Series(Start=0, Step=Slider(11, range=0..100), Count=10)
rotate = Rotate(Geometry=scale_nu.Geometry, Angle=degrees(series_2), Plane=PlaneXY(0, 0, 0))  # -> Geometry, Transform
Z_2 = UnitZ(Factor=Slider(6, range=0..10))
Z_3 = UnitZ(Factor=Slider(4.1, range=0..10))
extr = Extrude(Base=rotate.Geometry, Direction=Z_2)
move_2 = Move(Geometry=rotate.Geometry, Motion=Z_3)  # -> Geometry, Transform
cap = CapHoles(Brep=extr)
divide = DivideCurve(Curve=move_2.Geometry, Count=Slider(20, range=0..100), Kinks=False)  # -> Points, Tangents, Parameters
flip = FlipMatrix(Data=divide.Points)
intcrv = Interpolate(Vertices=flip, Degree=3, Periodic=False, KnotStyle=1)  # -> Curve, Length, Domain
