# Grasshopper definition Field Demo Alex.gh (Grasshopper 1.0.7)

# ---- group: Input and Controls
number_slider = Slider(9.3, range=-100..100)
pt = Point(<point referenced from the Rhino model>)
crv = Curve(<curve referenced from the Rhino model>)
number_slider_2 = Slider(0.4, range=-100..100)
crv_2 = Curve(<curve referenced from the Rhino model>)
pt_2 = Point(Point(3.393679106, -6.898106937, 0))
line = Line(crv)
line_2 = Line(crv_2)

# ---- group: Field Types
pcharge = PointCharge(Charge=number_slider, Decay=2)
fspin = SpinForce(Plane=pt_2, Strength=1, Radius=5, Decay=2)
fvector = VectorForce(Line=line_2)
lcharge = LineCharge(Line=line, Charge=number_slider_2)

# ----
rec = Rectangle({Plane=PlaneXY(6.650446687, -7.801120745, 0), Size=Domain2(u=-21.18989266..21.18989266, v=-24.16698502..24.16698502)})
mergef = MergeFields(Fields=[lcharge, fspin])
pop3d = Populate3D(
    Region={Plane=PlaneXY(0, 0, 0), X=Domain(0, 10), Y=Domain(0, 10), Z=Domain(0, 2)},
    Count=Slider(499, range=0..1000),
    Seed=1)
pop2d = Populate2D(Region=rec, Count=Slider(1000, range=0..1000), Seed=1)

# ---- group: Output and Display
fdir = DirectionDisplay(Field=mergef, Section=rec, Samples=1000)  # disabled
fline = FieldLine(Field=mergef, Point=pop3d, Steps=1000, Accuracy=0.1, Method=3)
ftensor = TensorDisplay(Field=mergef, Section=rec, Samples=1000)  # disabled
evf = EvaluateField(Field=mergef, Point=pop2d)  # -> Tensor, Strength
