# Grasshopper definition Field Demo.gh (Grasshopper 1.0.7)

# ---- group: Input and Controls
number_slider = Slider(-7.6, range=-100..200)
pt = Point(Point(-4.472128753, -49.11636314, 0))
crv = Curve(<curve referenced from the Rhino model>)
crv_2 = Curve(<curve referenced from the Rhino model>)
number_slider_2 = Slider(98.9, range=-100..100)
pt_2 = Point(Point(6.559273488, 10.60210598, 0))
line = Line(crv)
line_2 = Line(crv_2)

# ---- group: Field Types
pcharge = PointCharge(Point=pt_2, Charge=number_slider_2, Decay=2)
fspin = SpinForce(Plane=pt, Strength=1, Radius=5, Decay=2)
fvector = VectorForce(Line=line_2)
lcharge = LineCharge(Line=line, Charge=number_slider)

# ----
rec = Rectangle({Plane=PlaneXY(183.8851064, 2.536167464, 0), Size=Domain2(u=-144.891156..144.891156, v=-103.4021052..103.4021052)})
mergef = MergeFields(Fields=[fspin, lcharge, pcharge])
pop2d = Populate2D(Region=rec, Count=Slider(470, range=0..1000), Seed=1)  # disabled
pop3d = Populate3D(
    Region={Plane=PlaneXY(0, 0, 0), X=Domain(0, 10), Y=Domain(0, 10), Z=Domain(0, 2)},
    Count=Slider(396, range=0..1000),
    Seed=1)

# ---- group: Output and Display
fdir = DirectionDisplay(Section=rec, Samples=1000)
ftensor = TensorDisplay(Field=mergef, Section=rec, Samples=1000)
fline = FieldLine(Field=mergef, Point=pop3d, Steps=rec, Accuracy=0.1, Method=3)
evf = EvaluateField(Field=mergef, Point=pop3d)  # -> Tensor, Strength
