# Grasshopper definition New Urban ALT.gh (Grasshopper 1.0.7)
# plug-ins: Weaverbird

number_slider = Slider(10, range=0..10)
crv = Curve([<curve referenced from the Rhino model> x5])
rectangle = Rectangle(Plane=PlaneXY(0, 0, 0), XSize=number_slider, YSize=number_slider, Radius=0)  # -> Rectangle, Length
hexgrid = Hexagonal(Plane=PlaneXY(0, 0, 0), Size=Slider(10, range=0..10), ExtentX=Slider(5, range=0..100), ExtentY=Slider(6, range=0..100))  # -> Cells, Points
loft = Loft(Curves=crv, Options={Adjust=False, Closed=False, LoftEnds=0, LoftSimp=0, LoftType=0, Rebuild=10, Refit=0.01})
dom = ConstructDomain(DomainStart=Slider(0.88, range=0..1), DomainEnd=Slider(2.91, range=0..10))
number_slider_2 = Slider(7, range=0..10)
pop2d = Populate2D(Region=rectangle.Rectangle, Count=Slider(7, range=0..10), Seed=1)
project = Project(Curve=hexgrid.Cells, Brep=loft, Direction=Vector(0, 0, 1))
lng = ListLength(List=pop2d)
flatten = FlattenTree(Data=project, Path="{0}")
random = Random(Range=lng, Number=dom, Seed=2)
number_slider_3 = Slider(20, range=0..100)
rectangle_2 = Rectangle(Plane=pop2d, XSize=Domain(-1, 1), YSize=Domain(-2, 2), Radius=random)  # -> Rectangle, Length
disc = Discontinuity(Curve=flatten, Level=1)  # -> Points, Parameters
Z = UnitZ(Factor=Slider(6, range=0..10))
runion = RegionUnion(Curves=rectangle_2.Rectangle)
pline = PolyLine(Vertices=disc.Points, Closed=False)
Z_2 = UnitZ(Factor=Slider(0.5, range=0..1))
move = Move(Geometry=runion, Motion=Z)  # -> Geometry, Transform
boundary = BoundarySurfaces(Edges=runion)
wbcatmullclark = WeaverbirdsCatmullClarkSubdivision(MeshCurves=flatten(pline), Level=Slider(0, range=0..100), SmoothNakedEdges=1)
wbbeveledges = WeaverbirdsBevelEdges(MeshPolylines=flatten(pline), Distance=Slider(12, range=0..100), InsetType=0)
extr = Extrude(Base=boundary, Direction=Z_2)
divide = DivideCurve(Curve=move.Geometry, Count=Slider(56, range=0..100), Kinks=False)  # -> Points, Tangents, Parameters
dispatch = Dispatch(List=divide.Points, DispatchPattern=[True, False])  # -> ListA, ListB
medges = MeshEdges(Mesh=wbbeveledges)  # -> NakedEdges, InteriorEdges, NonManifoldEdges
extrcrv = ExtrudeAlong(Base=wbcatmullclark)
geo = Geometry(dispatch.ListA)
geo_2 = Geometry(dispatch.ListB)
pt = ConstructPoint(XCoordinate=0, YCoordinate=0, ZCoordinate=0)
shift = ShiftList(List=geo_2, Shift=Slider(35, range=0..100), Wrap=True)
project_2 = Project(Geometry=geo, Plane=pt)  # -> Geometry, Transform
ln = Line(StartPoint=project_2.Geometry, EndPoint=shift)
ln_2 = Line(StartPoint=geo_2, EndPoint=project_2.Geometry)
