# Grasshopper definition New Urban.gh (Grasshopper 1.0.7)

number_slider = Slider(10, range=0..10)
rectangle = Rectangle(Plane=PlaneXY(0, 0, 0), XSize=number_slider, YSize=number_slider, Radius=0)  # -> Rectangle, Length
dom = ConstructDomain(DomainStart=Slider(0.88, range=0..1), DomainEnd=Slider(2.91, range=0..10))
number_slider_2 = Slider(7, range=0..10)
pop2d = Populate2D(Region=rectangle.Rectangle, Count=Slider(7, range=0..10), Seed=1)
lng = ListLength(List=pop2d)
random = Random(Range=lng, Number=dom, Seed=2)
rectangle_2 = Rectangle(Plane=pop2d, XSize=Domain(-1, 1), YSize=Domain(-2, 2), Radius=random)  # -> Rectangle, Length
Z = UnitZ(Factor=Slider(6, range=0..10))
runion = RegionUnion(Curves=rectangle_2.Rectangle)
Z_2 = UnitZ(Factor=Slider(0.5, range=0..1))
move = Move(Geometry=runion, Motion=Z)  # -> Geometry, Transform
boundary = BoundarySurfaces(Edges=runion)
extr = Extrude(Base=boundary, Direction=Z_2)
divide = DivideCurve(Curve=move.Geometry, Count=Slider(56, range=0..100), Kinks=False)  # -> Points, Tangents, Parameters
dispatch = Dispatch(List=divide.Points, DispatchPattern=[True, False])  # -> ListA, ListB
geo = Geometry(dispatch.ListB)
geo_2 = Geometry(dispatch.ListA)
pt = ConstructPoint(XCoordinate=0, YCoordinate=0, ZCoordinate=0)
shift = ShiftList(List=geo, Shift=Slider(35, range=0..100), Wrap=True)
project = Project(Geometry=geo_2, Plane=pt)  # -> Geometry, Transform
ln = Line(StartPoint=shift, EndPoint=project.Geometry)
