# Grasshopper definition Para Tower Update.gh (Grasshopper 1.0.7)

number_slider = Slider(13, range=0..100)
number_slider_2 = Slider(35, range=0..100)
number_slider_3 = Slider(10, range=0..100)
number_slider_4 = Slider(10, range=0..100)
range = Range(Domain=Domain(0, 1), Steps=expr("x-1", number_slider_2))
polygon = Polygon(
    Plane=PlaneXY(0, 0, 0),
    Radius=Slider(15, range=0..100),
    Segments=Slider(4, range=0..10),
    FilletRadius=Slider(4, range=0..10))  # -> Polygon, Length
series = Series(Start=Slider(5, range=0..100), Step=number_slider, Count=number_slider_2)
Z = UnitZ(Factor=series)
graph = GraphMapper(
    range,
    x0=0,
    x1=1,
    y0=0,
    y1=1,
    container_name="Sine",
    Equation_px=[0.1581162214, 0.8701452613],
    Equation_py=[0.2187858224, 0.6638039947])
move = Move(Geometry=polygon.Polygon, Motion=Z)  # -> Geometry, Transform
cp = ControlPoints(Curve=move.Geometry)  # -> Points, Weights, Knots
bnd = Bounds(Numbers=graph)
series_2 = Series(Start=0, Step=Slider(13, range=0..100), Count=number_slider)
dom = ConstructDomain(DomainStart=Slider(10, range=0..100), DomainEnd=Slider(3, range=0..100))
avr = Average(Input=cp.Points)
remap = RemapNumbers(Value=graph, Source=bnd, Target=dom)  # -> Mapped, Clipped
scale_nu = ScaleNU(Geometry=move.Geometry, Plane=avr, ScaleX=remap.Mapped, ScaleY=remap.Mapped, ScaleZ=1)  # -> Geometry, Transform
rotate = Rotate(Geometry=scale_nu.Geometry, Angle=degrees(series_2), Plane=PlaneXY(0, 0, 0))  # -> Geometry, Transform
Z_2 = UnitZ(Factor=Slider(10, range=0..10))
pipe = Pipe(Curve=scale_nu.Geometry, Radius=Slider(1, range=0..100), Caps=0)
extr = Extrude(Base=rotate.Geometry, Direction=Z_2)
cap = CapHoles(Brep=extr)
