# Grasshopper definition Updated Field Demo Extruded.gh (Grasshopper 1.0.7)

crv = Curve(<curve referenced from the Rhino model>)
box = Box()

# ---- group: Input and Controls
pt = Point(<point referenced from the Rhino model>)
crv_2 = Curve(<curve referenced from the Rhino model>)
number_slider = Slider(-73.9, range=-100..100)
crv_3 = Curve(<curve referenced from the Rhino model>)
number_slider_2 = Slider(8.5, range=-100..100)
pt_2 = Point(<point referenced from the Rhino model>)
line = Line(crv_2)
line_2 = Line(crv_3)

# ----
line_3 = Line(crv)
pt_3 = Point()
pt_4 = Point()
pt_5 = Point()
pt_6 = Point()
pt_7 = Point()
pt_8 = Point()
pt_9 = Point()
pt_10 = Point()

# ---- group: Field Types
pcharge = PointCharge(Point=pt_2, Charge=number_slider_2, Decay=2)
fspin = SpinForce(Plane=pt, Strength=Slider(14.8, range=0..100), Radius=line_3, Decay=2)
lcharge = LineCharge(Line=line, Charge=number_slider)
fvector = VectorForce(Line=line_2)

# ----
crv_4 = Curve()
pcharge_2 = PointCharge(Charge=1, Decay=2)
mergef = MergeFields(Fields=[pcharge, fspin])
rec = Rectangle({Plane=PlaneXY(6.650446687, -7.801120745, 0), Size=Domain2(u=-21.18989266..21.18989266, v=-24.16698502..24.16698502)})
pop2d = Populate2D(Region=rec, Count=100, Seed=1)

# ---- group: Output and Display
fdir = DirectionDisplay(Field=mergef, Section=rec, Samples=1000)
fline = FieldLine(Field=mergef, Point=pop2d, Steps=1000, Accuracy=0.1, Method=3)
ftensor = TensorDisplay(Field=mergef, Section=rec, Samples=1000)
evf = EvaluateField(Field=mergef, Point=pop2d)  # -> Tensor, Strength
