# Grasshopper definition Updated Field Demo.gh (Grasshopper 1.0.7)

# ---- group: Input and Controls
pt = Point(<point referenced from the Rhino model>)
crv = Curve(<curve referenced from the Rhino model>)
number_slider = Slider(-14.4, range=-100..100)
crv_2 = Curve(<curve referenced from the Rhino model>)
number_slider_2 = Slider(3.4, range=-100..100)
pt_2 = Point(<point referenced from the Rhino model>)
line = Line(crv)
line_2 = Line(crv_2)

# ---- group: Field Types
pcharge = PointCharge(Point=pt_2, Charge=number_slider_2, Decay=2)
fspin = SpinForce(Plane=pt, Strength=Slider(7.5, range=0..100), Radius=5, Decay=2)
fvector = VectorForce(Line=line_2)
lcharge = LineCharge(Line=line, Charge=number_slider)

# ----
rec = Rectangle({Plane=PlaneXY(6.650446687, -7.801120745, 0), Size=Domain2(u=-21.18989266..21.18989266, v=-24.16698502..24.16698502)})
mergef = MergeFields(Fields=[pcharge, lcharge, fspin])
pop2d = Populate2D(Region=rec, Count=100, Seed=1)

# ---- group: Output and Display
fdir = DirectionDisplay(Field=mergef, Section=rec, Samples=1000)
fline = FieldLine(Field=mergef, Point=pop2d, Steps=1000, Accuracy=0.1, Method=3)
ftensor = TensorDisplay(Field=mergef, Section=rec, Samples=1000)
evf = EvaluateField(Field=mergef, Point=pop2d)  # -> Tensor, Strength

# ----
extr = Extrude(Base=fline, Direction=evf.Tensor)
