# Grasshopper definition HyperCube Attactor Points.gh (Grasshopper 1.0.7)

line = Line(Line((24249.62549, 2049.476763, 0), (33607.96231, 4143.351212, 0)))
pt = Point(<point referenced from the Rhino model>)
pcharge = PointCharge(Charge=1, Decay=2)
lcharge = LineCharge(Line=line, Charge=1)
fvector = VectorForce()
fspin = SpinForce(Plane=pt, Strength=1, Radius=5, Decay=2)
ftensor = TensorDisplay(Field=pcharge, Samples=1000)
pop2d = Populate2D(Region={Plane=PlaneXY(0, 0, 0), Size=Domain2(u=0..20, v=0..10)}, Count=100, Seed=1)
grid_on = BooleanToggle(True)

# ---- group: Single Point
pt_2 = Point(Point(-9.004113389, 33.37091811, 0))
graft = GraftTree(Tree=pt_2, IncludeEmptyLists=True, IncludeNullItems=True)

# ---- group: Grid of Points
rec = Rectangle({Plane=PlaneXY(-165.0760774, -2.229355189, 0), Size=Domain2(u=0..207.7671999, v=0..162.3601295)})
sdivide = DivideSurface(Surface=rec, UCount=10, VCount=10)  # -> simplify(graft(Points)), Normals, Parameters

# ---- group: Boolean to 1 and 0
panel = Panel("""True
False""")
switch_in = Boolean(grid_on)
xor = GateXor(A=switch_in, B=panel)
panel_2 = Panel("""0
1""")
dispatch = Dispatch(List=panel_2, DispatchPattern=xor)  # -> ListA, ListB
switch_out = Boolean(dispatch.ListA)

# ---- group: Uniform Control
md_slider = MDSlider(
    SliderMode=0,
    slider_value=Point(0.4471056868, 0.4575749839, 0.5),
    x_domain=Domain(0, 1),
    y_domain=Domain(0, 1),
    z_domain=Domain(0, 1))
Z = Slider(0.596, range=0..1)
gain = Slider(23.73, range=0..100)
scale = Slider(0.933, range=0.01..2)
neg = Negative(Value=gain)
devec = DeconstructVector(Vector=md_slider)  # -> XComponent, YComponent, ZComponent
dom = ConstructDomain(DomainStart=neg, DomainEnd=gain)
remap = RemapNumbers(Value=devec.XComponent, Source=Domain(0, 1), Target=dom)
remap_2 = RemapNumbers(Value=devec.YComponent, Source=Domain(0, 1), Target=dom)
remap_3 = RemapNumbers(Value=Z, Source=Domain(0, 1), Target=dom)
X = UnitX(Factor=remap)
Y = UnitY(Factor=remap_2)
Z_2 = UnitZ(Factor=remap_3)
addition = Addition(A=X, B=Y, C=Z_2)
dam = DataDam(DataA=addition, DataB=scale, BufferDelay=10000000, BufferMode=0)  # -> DataA, DataB

# ----
attractor_pts_on = BooleanToggle(True)

# ---- group: Boolean to 1 and 0
panel_3 = Panel("""True
False""")
switch_in_2 = Boolean(attractor_pts_on)
xor_2 = GateXor(A=switch_in_2, B=panel_3)
panel_4 = Panel("""0
1""")
dispatch_2 = Dispatch(List=panel_4, DispatchPattern=xor_2)  # -> ListA, ListB
switch_out_2 = Boolean(dispatch_2.ListA)

# ----
button = Button()
material = CreateMaterial(Diffuse=RGB(255, 105, 180), Specular=RGB(255, 255, 255), Emission=RGB(0, 0, 0), Transparency=0, Shine=0)

# ---- group: Z-Attractor
md_slider_2 = MDSlider(
    SliderMode=0,
    slider_value=Point(0.409718025, 0.3735894924, 0.5),
    x_domain=Domain(0, 1),
    y_domain=Domain(0, 1),
    z_domain=Domain(0, 1))
devec_2 = DeconstructVector(Vector=md_slider_2)  # -> XComponent, YComponent, ZComponent
drec = DeconstuctRectangle(Rectangle=rec)  # -> BasePlane, XInterval, YInterval
remap_4 = RemapNumbers(Value=devec_2.XComponent, Source=Domain(0, 1), Target=drec.XInterval)
remap_5 = RemapNumbers(Value=devec_2.YComponent, Source=Domain(0, 1), Target=drec.YInterval)
neg_2 = Negative(Value=Slider(-23, range=-500..1000))
pt_3 = Point(drec.BasePlane)
vec = VectorXYZ(XComponent=remap_4, YComponent=remap_5, ZComponent=neg_2)  # -> Vector, Length
move = Move(Geometry=pt_3, Motion=vec.Vector)  # -> Geometry, Transform

# ---- group: X Attractor
md_slider_3 = MDSlider(
    SliderMode=0,
    slider_value=Point(0.5128940489, 0.3906004371, 0.5),
    x_domain=Domain(0, 1),
    y_domain=Domain(0, 1),
    z_domain=Domain(0, 1))
devec_3 = DeconstructVector(Vector=md_slider_3)  # -> XComponent, YComponent, ZComponent
drec_2 = DeconstuctRectangle(Rectangle=rec)  # -> BasePlane, XInterval, YInterval
remap_6 = RemapNumbers(Value=devec_3.XComponent, Source=Domain(0, 1), Target=drec_2.XInterval)
remap_7 = RemapNumbers(Value=devec_3.YComponent, Source=Domain(0, 1), Target=drec_2.YInterval)
neg_3 = Negative(Value=Slider(11, range=-500..1000))
pt_4 = Point(drec_2.BasePlane)
vec_2 = VectorXYZ(XComponent=remap_6, YComponent=remap_7, ZComponent=neg_3)  # -> Vector, Length
move_2 = Move(Geometry=pt_4, Motion=vec_2.Vector)  # -> Geometry, Transform

# ---- group: Scale Attractor
md_slider_4 = MDSlider(
    SliderMode=0,
    slider_value=Point(0.5872311476, 0.6194614317, 0.5),
    x_domain=Domain(0, 1),
    y_domain=Domain(0, 1),
    z_domain=Domain(0, 1))
devec_4 = DeconstructVector(Vector=md_slider_4)  # -> XComponent, YComponent, ZComponent
drec_3 = DeconstuctRectangle(Rectangle=rec)  # -> BasePlane, XInterval, YInterval
remap_8 = RemapNumbers(Value=devec_4.XComponent, Source=Domain(0, 1), Target=drec_3.XInterval)
remap_9 = RemapNumbers(Value=devec_4.YComponent, Source=Domain(0, 1), Target=drec_3.YInterval)
neg_4 = Negative(Value=Slider(-7, range=-500..1000))
pt_5 = Point(drec_3.BasePlane)
vec_3 = VectorXYZ(XComponent=remap_8, YComponent=remap_9, ZComponent=neg_4)  # -> Vector, Length
move_3 = Move(Geometry=pt_5, Motion=vec_3.Vector)  # -> Geometry, Transform

# ---- group: Y-Attractor
md_slider_5 = MDSlider(
    SliderMode=0,
    slider_value=Point(0.6229421104, 0.3436733339, 0.5),
    x_domain=Domain(0, 1),
    y_domain=Domain(0, 1),
    z_domain=Domain(0, 1))
devec_5 = DeconstructVector(Vector=md_slider_5)  # -> XComponent, YComponent, ZComponent
drec_4 = DeconstuctRectangle(Rectangle=rec)  # -> BasePlane, XInterval, YInterval
remap_10 = RemapNumbers(Value=devec_5.XComponent, Source=Domain(0, 1), Target=drec_4.XInterval)
remap_11 = RemapNumbers(Value=devec_5.YComponent, Source=Domain(0, 1), Target=drec_4.YInterval)
neg_5 = Negative(Value=Slider(-20, range=-500..1000))
pt_6 = Point(drec_4.BasePlane)
vec_4 = VectorXYZ(XComponent=remap_10, YComponent=remap_11, ZComponent=neg_5)  # -> Vector, Length
move_4 = Move(Geometry=pt_6, Motion=vec_4.Vector)  # -> Geometry, Transform

# ---- group: Controller
number_slider = Slider(62.06, range=0..100)
number_slider_2 = Slider(1590.88, range=0..10000)
dam_2 = DataDam(BufferDelay=10000000, BufferMode=0)  # -> DataA, DataB

dom_2 = ConstructDomain(DomainStart=0, DomainEnd=number_slider_2)

dom_3 = ConstructDomain(DomainStart=0, DomainEnd=number_slider_2)

dom_4 = ConstructDomain(DomainStart=0, DomainEnd=number_slider_2)

dom_5 = ConstructDomain(DomainStart=0, DomainEnd=number_slider)

# ---- group: HyperCube Element
filter = StreamFilter(Gate=switch_out, Stream0=graft, Stream1=sdivide.Points)
size = Slider(11.776, range=0..16)
input_pt = Point(filter)
vec_5 = VectorXYZ(XComponent=size, YComponent=size, ZComponent=size)  # -> Vector, Length
viewer = ParamViewer(input_pt)
move_5 = Move(Geometry=input_pt, Motion=vec_5.Vector)  # -> Geometry, Transform
box = Box2Pt(PointA=input_pt, PointB=move_5.Geometry, Plane=PlaneXY(0, 0, 0))
box1 = Box(box)
debrep = DeconstructBrep(Brep=box1)  # -> graft(Faces), graft(Edges), graft(Vertices)
panel_5 = Panel("""False
False
False
False
True
True""")
path_mapper = PathMapper(debrep.Faces, source="{A;B;C;D}", target="{A;B}")
not = GateNot(A=panel_5)
cull = CullPattern(List=path_mapper, CullPattern=not)
join = BrepJoin(Breps=cull)  # -> Breps, Closed

# ---- group: Z-Attractor (continued)
vec2pt = Vector2Pt(PointA=filter, PointB=move.Geometry, Unitize=False)  # -> Vector, Length
unit = UnitVector(Vector=vec2pt.Vector)

# ---- group: X Attractor (continued)
vec2pt_2 = Vector2Pt(PointA=filter, PointB=move_2.Geometry, Unitize=False)  # -> Vector, Length
unit_2 = UnitVector(Vector=vec2pt_2.Vector)

# ---- group: Scale Attractor (continued)
vec2pt_3 = Vector2Pt(PointA=filter, PointB=move_3.Geometry, Unitize=False)  # -> Vector, Length
unit_3 = UnitVector(Vector=vec2pt_3.Vector)

# ---- group: Y-Attractor (continued)
vec2pt_4 = Vector2Pt(PointA=filter, PointB=move_4.Geometry, Unitize=False)  # -> Vector, Length
unit_4 = UnitVector(Vector=vec2pt_4.Vector)

# ---- group: Controller (continued)
devec_6 = DeconstructVector(Vector=unit_2)  # -> XComponent, YComponent, ZComponent
one_over_x = OneOverX(Value=vec2pt_2.Length)
remap_12 = RemapNumbers(Value=one_over_x, Source=Domain(0, 1), Target=dom_2)
multiplication = Multiplication(A=devec_6.XComponent, B=remap_12)
panel_6 = Panel(remap_12)
X_2 = UnitX(Factor=multiplication)

devec_7 = DeconstructVector(Vector=unit_4)  # -> XComponent, YComponent, ZComponent
one_over_x_2 = OneOverX(Value=vec2pt_4.Length)
remap_13 = RemapNumbers(Value=one_over_x_2, Source=Domain(0, 1), Target=dom_3)
multiplication_2 = Multiplication(A=devec_7.YComponent, B=remap_13)
panel_7 = Panel(multiplication_2)
Y_2 = UnitY(Factor=multiplication_2)

devec_8 = DeconstructVector(Vector=unit)  # -> XComponent, YComponent, ZComponent
one_over_x_3 = OneOverX(Value=vec2pt.Length)
remap_14 = RemapNumbers(Value=one_over_x_3, Source=Domain(0, 1), Target=dom_4)
multiplication_3 = Multiplication(A=devec_8.XComponent, B=devec_8.YComponent)
sqr = Square(Value=remap_14)
multiplication_4 = Multiplication(A=multiplication_3, B=sqr)
panel_8 = Panel(multiplication_4)
Z_3 = UnitZ(Factor=multiplication_4)

one_over_x_4 = OneOverX(Value=vec2pt_3.Length)
remap_15 = RemapNumbers(Value=one_over_x_4, Source=Domain(0, 1), Target=dom_5)
panel_9 = Panel(remap_15)

addition_2 = Addition(A=X_2, B=Y_2, C=Z_3)

# ---- group: HyperCube Element (continued)
filter_2 = StreamFilter(Gate=switch_out_2, Stream1=addition_2)
filter_3 = StreamFilter(Gate=switch_out_2, Stream0=dam.DataA, Stream1=addition_2)
position_input = Vector(filter_3)
scale_input = Number(filter_2)
move_6 = Move(Geometry=box1, Motion=position_input)  # -> Geometry, Transform
volume = Volume(Geometry=move_6.Geometry)  # -> Volume, Centroid
scale_2 = Scale(Geometry=move_6.Geometry, Center=volume.Centroid, Factor=scale_input)  # -> Geometry, Transform
box2 = Box(scale_2.Geometry)
debrep_2 = DeconstructBrep(Brep=box2)  # -> graft(Faces), graft(Edges), graft(Vertices)
line_2 = Line([debrep.Edges, debrep_2.Edges])
loft = Loft(Curves=line_2, Options={Adjust=False, Closed=False, LoftEnds=0, LoftSimp=0, LoftType=0, Rebuild=10, Refit=0.01})
path_mapper_2 = PathMapper(loft, source="{A;B;C;D}", target="{A;B}")
path_mapper_3 = PathMapper(debrep_2.Faces, source="{A;B;C;D}", target="{A;B}")
cull_2 = CullPattern(List=path_mapper_3, CullPattern=not)
join_2 = BrepJoin(Breps=cull_2)  # -> Breps, Closed
join_3 = BrepJoin(Breps=[join.Breps, join_2.Breps, path_mapper_2])  # -> Breps, Closed
hypercubes = Brep(join_3.Breps)

# ----
brep = Brep(hypercubes)
preview = CustomPreview(Geometry=brep, Material=material)
