# Grasshopper definition HyperCube Element.gh (Grasshopper 1.0.7)

box = Box({Plane=PlaneXY(22.78571217, -25.75274666, 0), X=Domain(0, 16), Y=Domain(0, 16), Z=Domain(0, 16)})
vec = VectorXYZ(XComponent=Slider(0, range=0..100), YComponent=Slider(0, range=0..100), ZComponent=Slider(0, range=0..100))  # -> Vector, Length
move = Move(Geometry=box, Motion=vec.Vector)  # -> Geometry, Transform
volume = Volume(Geometry=move.Geometry)  # -> Volume, Centroid
debrep = DeconstructBrep(Brep=box)  # -> simplify(graft(Faces)), graft(Edges), Vertices
scale = Scale(Geometry=move.Geometry, Center=volume.Centroid, Factor=Slider(0.588, range=0..2))  # -> Geometry, Transform
debrep_2 = DeconstructBrep(Brep=scale.Geometry)  # -> simplify(graft(Faces)), graft(Edges), Vertices
number_slider = Slider(2.9, range=0..10)
line = Line([debrep.Edges, debrep_2.Edges])
ln = Line(StartPoint=debrep.Vertices, EndPoint=debrep_2.Vertices)
loft = Loft(Curves=line, Options={Adjust=False, Closed=False, LoftEnds=0, LoftSimp=0, LoftType=0, Rebuild=10, Refit=0.01})  # -> simplify(Loft)
ext = ExtendCurve(Curve=ln, Type=0, Start=number_slider, End=number_slider)
bang = ExplodeTree(Data=debrep.Faces)  # -> Branch0, Branch1, Branch2, Branch3
bang_2 = ExplodeTree(Data=loft)  # -> Branch0, Branch1, Branch2, Branch3, Branch4, Branch5, Branch6, Branch7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
bang_3 = ExplodeTree(Data=debrep_2.Faces)  # -> Branch0, Branch1, Branch2, Branch3
merge = Merge(
    Data1=bang.Branch0,
    Data2=bang.Branch1,
    Data3=bang.Branch2,
    Data4=bang.Branch3,
    Data5=bang_2.Branch0,
    Data6=bang_2.Branch1,
    Data7=bang_2.Branch2,
    Data8=bang_2.Branch3,
    Data9=bang_2.Branch4,
    Data10=bang_2.Branch5,
    Data11=bang_2.Branch6,
    Data12=bang_2.Branch7,
    Data13=bang_2.Branch8,
    Data14=bang_2.Branch9,
    Data15=bang_2.Branch10,
    Data16=bang_2.Branch11,
    Data17=bang_3.Branch0,
    Data18=bang_3.Branch1,
    Data19=bang_3.Branch2,
    Data20=bang_3.Branch3)
