# Grasshopper definition SurfaceLabyrinthev0.5.1_with_top - Hemme.gh (Grasshopper 1.0.7)
# plug-ins: Bifocals

number_slider = Slider(5, range=-10..50)
surface = Surface(<surface referenced from the Rhino model>)
surface_2 = Surface(<surface referenced from the Rhino model>)
number_slider_2 = Slider(16, range=0..100)
random = Random(Range=Domain(0, 20), Number=number_slider_2, Seed=10)
random_2 = Random(Range=Domain(0, 20), Number=Slider(6.763, range=-10..10), Seed=10)
random_3 = Random(Range=Domain(0, 25), Number=number_slider, Seed=10)
offset_surface = Offset(Surface=surface, Distance=number_slider, Retrim=True)
divide_domain² = DivideDomain²(Domain=surface_2, UCount=random, VCount=random)
offset_surface_2 = Offset(Surface=surface_2, Distance=random_2, Retrim=True)
random_4 = Random(Range=Domain(0, 7), Number=Slider(1, range=1..100), Seed=10)
isotrim = Isotrim(Surface=surface_2, Domain=divide_domain²)
point = Point(<point referenced from the Rhino model>)
divide_surface = DivideSurface(Surface=isotrim, UCount=1, VCount=1)  # -> Points, Normals, Parameters; disabled
random_5 = Random(Range=Domain(0, 7), Number=Slider(13, range=5..100), Seed=10)
scale = Scale(Geometry=offset_surface, Center=point, Factor=random_5)  # -> Geometry, Transform
maelstrom = Maelstrom(Geometry=scale.Geometry, Plane=surface, First=0.1, Second=10, Angle=random_4, Rigid=False)
deconstruct_brep = DeconstructBrep(Brep=isotrim)  # -> Faces, Edges, Vertices
geometry = Geometry(deconstruct_brep.Faces)
area = Area(Geometry=geometry)  # -> Area, Centroid
geometry_2 = Geometry(simplify(deconstruct_brep.Edges))
geometry_3 = Geometry(simplify(deconstruct_brep.Edges))
c_script = CSharpScript(edges=geometry_2, rows=number_slider_2, columns=number_slider_2)  # -> out, A; inputs edges: tree of Curve, rows: Int32, columns: Int32
# ---------- c_script: C# usings ----------
using System.IO;
using System.Linq;
using System.Data;
using System.Drawing;
using System.Reflection;
using System.Windows.Forms;
using System.Xml;
using System.Xml.Linq;
using System.Runtime.InteropServices;

using Rhino.DocObjects;
using Rhino.Collections;
using GH_IO;
using GH_IO.Serialization;
# ---------- c_script: C# ----------
    var listExport = new List<Curve>();
    var grid = new Grid(rows, columns);
    grid.Generate();


    Print((edges.BranchCount).ToString());
    int counter = 0;
    for (int x = 0; x < rows; x++){
      for (int y = 0; y < columns; y++){


        //Print(" " + x.ToString() + "," + y.ToString() + "  " + ((Grid.Directions) (grid.Cells[y, x])).ToString());
        //var n = ((Grid.Directions) (grid.Cells[x, y])).HasFlag(Grid.Directions.N) ? "N" : "-";

        var s = ((Grid.Directions) (grid.Cells[x, y])).HasFlag(Grid.Directions.S) ? "S" : "-";
        if( s == "-" && x != (rows - 1) ){
          GH_Path pth = new GH_Path(counter);
          //Print(pth.ToString());
          //Print( (edges.Branch(1)).ToString());
          listExport.Add(edges.Branch(counter)[1]);
        }

        var e = ((Grid.Directions) (grid.Cells[x, y])).HasFlag(Grid.Directions.E) ? "E" : "-";
        if( e == "-" && y != (rows - 1) ){
          GH_Path pth = new GH_Path(counter);
          //Print(pth.ToString());
          //Print( (edges.Branch(1)[1]).ToString());
          listExport.Add(edges.Branch(counter)[2]);
        }


        Print(" " + x.ToString() + "," + y.ToString() + "  " + s + e);
        counter++;
        Print(counter.ToString());
      }
    }

    A = listExport;
# ---------- c_script: C# additional code ----------
  public class Grid
  {

    public enum Directions
    {
      N = 1,
      S = 2,
      E = 4,
      W = 8
    };


    private const int _rowDimension = 0;
    private const int _columnDimension = 1;

    public int MinSize { get; private set; }
    public int MaxSize { get; private set; }
    public int[,] Cells { get; private set; }

    public Grid() : this(3, 3)
    {

    }

    public Grid(int rows, int columns)
    {
      MinSize = 3;
      MaxSize = 10;
      Cells = Initialise(rows, columns);
    }

    public int[,] Initialise(int rows, int columns)
    {
      /*
      if (rows < MinSize)
        rows = MinSize;

      if (columns < MinSize)
        columns = MinSize;

      if (rows > MaxSize)
        rows = MaxSize;

      if (columns > MaxSize)
        columns = MaxSize;
      */

      var cells = new int[rows, columns];

      for (int i = 0; i < rows; i++)
      {
        for (int j = 0; j < columns; j++)
        {
          cells[i, j] = 0;
        }
      }

      return cells;
    }

    private Dictionary<Directions, int> DirectionX = new Dictionary<Directions, int>
      {
        { Directions.N, 0 },
        { Directions.S, 0 },
        { Directions.E, 1 },
        { Directions.W, -1 }
        };

    private Dictionary<Directions, int> DirectionY = new Dictionary<Directions, int>
      {
        { Directions.N, -1 },
        { Directions.S, 1 },
        { Directions.E, 0 },
        { Directions.W, 0 }
        };

    private Dictionary<Directions, Directions> Opposite = new Dictionary<Directions, Directions>
      {
        { Directions.N, Directions.S },
        { Directions.S, Directions.N },
        { Directions.E, Directions.W },
        { Directions.W, Directions.E }
        };

    public int[,] Generate()
    {
      var cells = Cells;
      CarvePassagesFrom(0, 0, ref cells);
      return cells;
    }

    public void CarvePassagesFrom(int currentX, int currentY, ref int[,] grid)
    {
      var directions = new List<Directions>
        {
          Directions.N,
          Directions.S,
          Directions.E,
          Directions.W
          }
        .OrderBy(x => Guid.NewGuid());

      foreach (var direction in directions)
      {
        var nextX = currentX + DirectionX[direction];
        var nextY = currentY + DirectionY[direction];

        if (IsOutOfBounds(nextX, nextY, grid))
          continue;

        if (grid[nextY, nextX] != 0) // has been visited
          continue;

        grid[currentY, currentX] |= (int) direction;
        grid[nextY, nextX] |= (int) Opposite[direction];

        CarvePassagesFrom(nextX, nextY, ref grid);
      }
    }

    private bool IsOutOfBounds(int x, int y, int[,] grid)
    {
      if (x < 0 || x > grid.GetLength(_rowDimension) - 1)
        return true;

      if (y < 0 || y > grid.GetLength(_columnDimension) - 1)
        return true;

      return false;
    }

    public void consolePrint(int[,] grid)
    {
      var rows = grid.GetLength(_rowDimension);
      var columns = grid.GetLength(_columnDimension);

      // Top line
      Console.Write(" ");
      for (int i = 0; i < columns; i++)
        Console.Write(" _");
      Console.WriteLine();

      for (int y = 0; y < rows; y++)
      {
        Console.Write(" |");

        for (int x = 0; x < columns; x++)
        {
          var directions = (Directions) grid[y, x];

          var s = directions.HasFlag(Directions.S) ? " " : "_";

          Console.Write(s);

          s = directions.HasFlag(Directions.E) ? " " : "|";

          Console.Write(s);
        }

        Console.WriteLine();
      }
    }
  }
# ---------- end c_script ----------
c_script_2 = CSharpScript(edges=geometry_3, rows=number_slider_2, columns=number_slider_2)  # -> out, A; inputs edges: tree of Curve, rows: Int32, columns: Int32; same code as c_script
geometry_4 = Geometry(deconstruct_brep.Vertices)
param_viewer = ParamViewer(geometry_2)
panel = Panel(geometry_2)
panel_2 = Panel(c_script.out)
curve = Curve(c_script.A)
random_6 = Random(Range=Slider(32, range=-10..40), Number=50, Seed=10)
unit_z = UnitZ(Factor=random_6)
join_curves = JoinCurves(Curves=curve, Preserve=False)
number_slider_3 = Slider(0.547, range=0..1)
extrude = Extrude(Base=join_curves, Direction=unit_z)
_2bake = Geometry(extrude)
list_length = ListLength(List=extrude)
construct_domain = ConstructDomain(DomainStart=0, DomainEnd=list_length)
evaluate_length = EvaluateLength(Length=number_slider_3, Normalized=True)  # -> Point, Tangent, Parameter
evaluate_length_2 = EvaluateLength(Length=number_slider_3, Normalized=True)  # -> Point, Tangent, Parameter
remap_numbers = RemapNumbers(Value=Slider(0.499, range=0..1), Source=Domain(0, 1), Target=construct_domain)  # -> Mapped, Clipped
offset_curve = Offset(Distance=1, Plane=PlaneXY(0, 0, 0), Corners=1)  # -> flatten(Curve)
number_slider_4 = Slider(0.5807, range=0..1)
list_item = ListItem(List=join_curves, Index=remap_numbers.Mapped, Wrap=True)
move = Move(Geometry=offset_curve, Motion=evaluate_length.Tangent)  # -> simplify(graft(Geometry)), Transform
negative = Negative(Value=number_slider_4)
offset_on_srf = OffsetOnSrf(Curve=list_item, Distance=negative, Surface=surface_2)  # disabled
object_details = ObjectDetails(Object=list_item)  # -> Referenced, Available, Name, Layer, Colour, Guid
evaluate_surface = EvaluateSurface(Point=evaluate_length_2.Point)  # -> Point, Normal, Frame
offset_on_srf_2 = OffsetOnSrf(Curve=list_item, Distance=number_slider_4, Surface=surface_2)
loft = Loft(
    Curves=[offset_on_srf_2, offset_on_srf],
    Options={Adjust=False, Closed=False, LoftEnds=0, LoftSimp=0, LoftType=0, Rebuild=10, Refit=0.01})
move_2 = Move(Geometry=loft, Motion=unit_z)  # -> Geometry, Transform
panel_3 = Panel(list_item)
curve_2 = Curve()
move_3 = Move(Geometry=offset_curve, Motion=evaluate_surface.Normal)  # -> simplify(graft(Geometry)), Transform
curve_3 = Curve()
loft_2 = Loft(
    Curves=[curve_2, move.Geometry],
    Options={Adjust=False, Closed=False, LoftEnds=0, LoftSimp=0, LoftType=0, Rebuild=10, Refit=0.01})
loft_3 = Loft(
    Curves=[curve_3, move_3.Geometry],
    Options={Adjust=False, Closed=False, LoftEnds=0, LoftSimp=0, LoftType=0, Rebuild=10, Refit=0.01})
