# Grasshopper definition SurfaceLabyrinthev0.5.1_with_top.gh (Grasshopper 1.0.7)

number_slider = Slider(28, range=0..100)
srf = Surface(<surface referenced from the Rhino model>)
number_slider_2 = Slider(0.5, range=0..1)
crv = Curve(<curve referenced from the Rhino model>)
divide = DivideDomain²(Domain=srf, UCount=number_slider, VCount=number_slider)
eval = EvaluateLength(Length=number_slider_2, Normalized=True)  # -> Point, Tangent, Parameter
offset = Offset(Distance=1, Plane=PlaneXY(0, 0, 0), Corners=1)  # -> flatten(Curve)
viewer = ParamViewer()
subsrf = Isotrim(Surface=srf, Domain=divide)
eval_2 = EvaluateLength(Length=number_slider_2, Normalized=True)  # -> Point, Tangent, Parameter
debrep = DeconstructBrep(Brep=subsrf)  # -> Faces, Edges, Vertices
crv_2 = Curve()
sdivide = DivideSurface(Surface=subsrf, UCount=1, VCount=1)  # -> Points, Normals, Parameters
evalsrf = EvaluateSurface(Surface=srf, Point=eval_2.Point)  # -> Point, Normal, Frame
geo = Geometry(debrep.Vertices)
geo_2 = Geometry(debrep.Faces)
geo_3 = Geometry(simplify(debrep.Edges))
viewer_2 = ParamViewer(geo_3)
panel = Panel(geo_3)
move = Move(Geometry=offset, Motion=eval.Tangent)  # -> simplify(graft(Geometry)), Transform
area = Area(Geometry=geo_2)  # -> Area, Centroid
crv_3 = Curve()
offset_2 = Offset(Surface=srf, Distance=Slider(-0.854, range=-10..10), Retrim=True)
loft = Loft(
    Curves=[crv_2, move.Geometry],
    Options={Adjust=False, Closed=False, LoftEnds=0, LoftSimp=0, LoftType=0, Rebuild=10, Refit=0.01})
move_2 = Move(Geometry=offset, Motion=evalsrf.Normal)  # -> simplify(graft(Geometry)), Transform
loft_2 = Loft(
    Curves=[crv_3, move_2.Geometry],
    Options={Adjust=False, Closed=False, LoftEnds=0, LoftSimp=0, LoftType=0, Rebuild=10, Refit=0.01})
c_script = CSharpScript(edges=geo_3, rows=number_slider, columns=number_slider)  # -> out, A; inputs edges: tree of Curve, rows: Int32, columns: Int32
# ---------- c_script: C# usings ----------
using System.IO;
using System.Linq;
using System.Data;
using System.Drawing;
using System.Reflection;
using System.Windows.Forms;
using System.Xml;
using System.Xml.Linq;
using System.Runtime.InteropServices;

using Rhino.DocObjects;
using Rhino.Collections;
using GH_IO;
using GH_IO.Serialization;
# ---------- c_script: C# ----------
    var listExport = new List<Curve>();
    var grid = new Grid(rows, columns);
    grid.Generate();


    Print((edges.BranchCount).ToString());
    int counter = 0;
    for (int x = 0; x < rows; x++){
      for (int y = 0; y < columns; y++){


        //Print(" " + x.ToString() + "," + y.ToString() + "  " + ((Grid.Directions) (grid.Cells[y, x])).ToString());
        //var n = ((Grid.Directions) (grid.Cells[x, y])).HasFlag(Grid.Directions.N) ? "N" : "-";

        var s = ((Grid.Directions) (grid.Cells[x, y])).HasFlag(Grid.Directions.S) ? "S" : "-";
        if( s == "-" && x != (rows - 1) ){
          GH_Path pth = new GH_Path(counter);
          //Print(pth.ToString());
          //Print( (edges.Branch(1)).ToString());
          listExport.Add(edges.Branch(counter)[1]);
        }

        var e = ((Grid.Directions) (grid.Cells[x, y])).HasFlag(Grid.Directions.E) ? "E" : "-";
        if( e == "-" && y != (rows - 1) ){
          GH_Path pth = new GH_Path(counter);
          //Print(pth.ToString());
          //Print( (edges.Branch(1)[1]).ToString());
          listExport.Add(edges.Branch(counter)[2]);
        }


        Print(" " + x.ToString() + "," + y.ToString() + "  " + s + e);
        counter++;
        Print(counter.ToString());
      }
    }

    A = listExport;
# ---------- c_script: C# additional code ----------
  public class Grid
  {

    public enum Directions
    {
      N = 1,
      S = 2,
      E = 4,
      W = 8
    };


    private const int _rowDimension = 0;
    private const int _columnDimension = 1;

    public int MinSize { get; private set; }
    public int MaxSize { get; private set; }
    public int[,] Cells { get; private set; }

    public Grid() : this(3, 3)
    {

    }

    public Grid(int rows, int columns)
    {
      MinSize = 3;
      MaxSize = 10;
      Cells = Initialise(rows, columns);
    }

    public int[,] Initialise(int rows, int columns)
    {
      /*
      if (rows < MinSize)
        rows = MinSize;

      if (columns < MinSize)
        columns = MinSize;

      if (rows > MaxSize)
        rows = MaxSize;

      if (columns > MaxSize)
        columns = MaxSize;
      */

      var cells = new int[rows, columns];

      for (int i = 0; i < rows; i++)
      {
        for (int j = 0; j < columns; j++)
        {
          cells[i, j] = 0;
        }
      }

      return cells;
    }

    private Dictionary<Directions, int> DirectionX = new Dictionary<Directions, int>
      {
        { Directions.N, 0 },
        { Directions.S, 0 },
        { Directions.E, 1 },
        { Directions.W, -1 }
        };

    private Dictionary<Directions, int> DirectionY = new Dictionary<Directions, int>
      {
        { Directions.N, -1 },
        { Directions.S, 1 },
        { Directions.E, 0 },
        { Directions.W, 0 }
        };

    private Dictionary<Directions, Directions> Opposite = new Dictionary<Directions, Directions>
      {
        { Directions.N, Directions.S },
        { Directions.S, Directions.N },
        { Directions.E, Directions.W },
        { Directions.W, Directions.E }
        };

    public int[,] Generate()
    {
      var cells = Cells;
      CarvePassagesFrom(0, 0, ref cells);
      return cells;
    }

    public void CarvePassagesFrom(int currentX, int currentY, ref int[,] grid)
    {
      var directions = new List<Directions>
        {
          Directions.N,
          Directions.S,
          Directions.E,
          Directions.W
          }
        .OrderBy(x => Guid.NewGuid());

      foreach (var direction in directions)
      {
        var nextX = currentX + DirectionX[direction];
        var nextY = currentY + DirectionY[direction];

        if (IsOutOfBounds(nextX, nextY, grid))
          continue;

        if (grid[nextY, nextX] != 0) // has been visited
          continue;

        grid[currentY, currentX] |= (int) direction;
        grid[nextY, nextX] |= (int) Opposite[direction];

        CarvePassagesFrom(nextX, nextY, ref grid);
      }
    }

    private bool IsOutOfBounds(int x, int y, int[,] grid)
    {
      if (x < 0 || x > grid.GetLength(_rowDimension) - 1)
        return true;

      if (y < 0 || y > grid.GetLength(_columnDimension) - 1)
        return true;

      return false;
    }

    public void consolePrint(int[,] grid)
    {
      var rows = grid.GetLength(_rowDimension);
      var columns = grid.GetLength(_columnDimension);

      // Top line
      Console.Write(" ");
      for (int i = 0; i < columns; i++)
        Console.Write(" _");
      Console.WriteLine();

      for (int y = 0; y < rows; y++)
      {
        Console.Write(" |");

        for (int x = 0; x < columns; x++)
        {
          var directions = (Directions) grid[y, x];

          var s = directions.HasFlag(Directions.S) ? " " : "_";

          Console.Write(s);

          s = directions.HasFlag(Directions.E) ? " " : "|";

          Console.Write(s);
        }

        Console.WriteLine();
      }
    }
  }
# ---------- end c_script ----------
Z = UnitZ(Factor=Slider(2.393, range=-10..10))
panel_2 = Panel(c_script.out)
crv_4 = Curve(c_script.A)
join = JoinCurves(Curves=crv_4, Preserve=False)
extr = Extrude(Base=join, Direction=Z)
_2bake = Geometry(extr)
lng = ListLength(List=extr)
dom = ConstructDomain(DomainStart=0, DomainEnd=lng)
objdet = ObjectDetails()  # -> Referenced, Available, Name, Layer, Colour, Guid
remap = RemapNumbers(Value=Slider(0.458, range=0..1), Source=Domain(0, 1), Target=dom)  # -> Mapped, Clipped
item = ListItem(List=join, Index=remap.Mapped, Wrap=True)
panel_3 = Panel(item)
objdet_2 = ObjectDetails(Object=item)  # -> Referenced, Available, Name, Layer, Colour, Guid
number_slider_3 = Slider(0.1761, range=0..1)
neg = Negative(Value=number_slider_3)
offsets = OffsetOnSrf(Curve=item, Distance=number_slider_3, Surface=srf)
offsets_2 = OffsetOnSrf(Curve=item, Distance=neg, Surface=srf)
loft_3 = Loft(
    Curves=[offsets, offsets_2],
    Options={Adjust=False, Closed=False, LoftEnds=0, LoftSimp=0, LoftType=0, Rebuild=10, Refit=0.01})
move_3 = Move(Geometry=loft_3, Motion=Z)  # -> Geometry, Transform
