# Grasshopper definition Tower.gh (Grasshopper 1.0.7)

number_slider = Slider(5, range=0..100)
number_slider_2 = Slider(30, range=0..100)
series = Series(Start=Slider(5, range=0..100), Step=number_slider, Count=number_slider_2)
polygon = Polygon(
    Plane=PlaneXY(0, 0, 0),
    Radius=Slider(20, range=0..100),
    Segments=Slider(4, range=0..100),
    FilletRadius=Slider(6, range=0..100))  # -> Polygon, Length
range = Range(Domain=Domain(0, 1), Steps=expr("x-1", number_slider_2))
Z = UnitZ(Factor=series)
move = Move(Geometry=polygon.Polygon, Motion=Z)  # -> Geometry, Transform
graph = GraphMapper(range, x0=0, x1=1, y0=0, y1=1, container_name="Sine", Equation_px=[0, 0.9240740538], Equation_py=[0, 0.8621029854])
cp = ControlPoints(Curve=move.Geometry)  # -> Points, Weights, Knots
dom = ConstructDomain(DomainStart=Slider(4, range=0..100), DomainEnd=Slider(2, range=0..100))
bnd = Bounds(Numbers=graph)
avr = Average(Input=cp.Points)
remap = RemapNumbers(Value=graph, Source=bnd, Target=dom)  # -> Mapped, Clipped
scale_nu = ScaleNU(Geometry=move.Geometry, Plane=avr, ScaleX=remap.Mapped, ScaleY=remap.Mapped, ScaleZ=1)  # -> Geometry, Transform
series_2 = Series(Start=0, Step=Slider(9, range=0..10), Count=number_slider)
rotate = Rotate(Geometry=scale_nu.Geometry, Angle=degrees(series_2), Plane=PlaneXY(0, 0, 0))  # -> Geometry, Transform
Z_2 = UnitZ(Factor=Slider(5, range=0..10))
Z_3 = UnitZ(Factor=Slider(2.5, range=0..10))
extr = Extrude(Base=rotate.Geometry, Direction=Z_2)
move_2 = Move(Geometry=rotate.Geometry, Motion=Z_3)  # -> Geometry, Transform
cap = CapHoles(Brep=extr)
divide = DivideCurve(Curve=move_2.Geometry, Count=Slider(24, range=0..100), Kinks=False)  # -> Points, Tangents, Parameters
intcrv = Interpolate(Vertices=divide.Points, Degree=3, Periodic=False, KnotStyle=1)  # -> Curve, Length, Domain
ext = ExtendCurve(Curve=intcrv.Curve, Type=0, Start=Z_3, End=Z_3)
end = EndPoints(Curve=ext)  # -> flatten(Start), flatten(End)
intcrv_2 = Interpolate(Vertices=end.Start, Degree=3, Periodic=invert(False), KnotStyle=1)  # -> Curve, Length, Domain
pipe = Pipe(Curve=ext, Radius=Slider(0.641, range=0..1), Caps=0)
