# Grasshopper definition Wong, ARCH 741 Project GH.gh (Grasshopper 1.0.7)

extent_y = Slider(8, range=0..10)

# ----
# handle with care >
number_slider = Slider(3, range=2..6)

min_height = Slider(2, range=0..11)
max_height = Slider(7, range=0..10)
number_slider_2 = Slider(3, range=0..10)
pln = Plane(Plane(origin=(56.86554985, -37.49987507, 0), x=(0.986678737, 0.1626808837, 0), y=(0.1493731683, -0.9059658739, 0.3961230766)))
box = Box({Plane=Plane(origin=(31.96626822, -38.65510932, 0), x=(0, 1, 0), y=(1, 0, 0)), X=Domain(0, 15.78780439), Y=Domain(0, 12.80539176), Z=Domain(0, 11.36123181)})
list = ValueList({"One": 1, "Two": 2, "Three": 2² - 1, "Four": Sqrt(16)}, selected="Four")
dom = ConstructDomain(DomainStart=min_height, DomainEnd=max_height)
sqgrid = Square(Plane=PlaneXY(0, 0, 0), Size=list, ExtentX=extent_y, ExtentY=extent_y)  # -> Cells, Points
series = Series(Start=Slider(0, range=0..20), Step=Slider(4, range=0..4), Count=number_slider_2)
polygon = Polygon(Plane=PlaneXY(0, 0, 0), Radius=3, Segments=6, FilletRadius=0)  # -> Polygon, Length
pi = Pi(Factor=1)
arrpolar = PolarArray(Geometry=box, Plane=pln, Count=Slider(18, range=0..50), Angle=degrees(Slider(360, range=0..360)))  # -> Geometry, Transform
Y = UnitY(Factor=1)
Z = UnitZ(Factor=1)
_90_0_90 = Slider(4, range=0..20)
range = Range(Domain=Domain(0, 1), Steps=expr("x-1", number_slider_2))
polygon_2 = Polygon(
    Plane=PlaneXY(0, 0, 0),
    Radius=Slider(20, range=0..20),
    Segments=Slider(4, range=0..8),
    FilletRadius=Slider(1, range=0..10))  # -> Polygon, Length; disabled
number_slider_3 = Slider(4, range=0..20)
rad = Radians(Degrees=Slider(-34, range=-90..90))
z = Slider(15.7, range=-20..20)
pts = Point(flatten(sqgrid.Points))
neg = Negative(Value=pi)
Z_2 = UnitZ(Factor=series)
viewer = ParamViewer(sqgrid.Points)
vrot = Rotate(Vector=Y, Axis=Z, Angle=rad)
lng = ListLength(List=pts)
arrrec = RectangularArray(
    Geometry=arrpolar.Geometry,
    Cell={Plane=PlaneXY(0, 0, 0), Size=Domain2(u=0..10, v=0..5)},
    XCount=Slider(119, range=0..360),
    YCount=Slider(0, range=0..360))  # -> Geometry, Transform
dom_2 = Domain(DomainStart=neg, DomainEnd=pi)
pt = PointXYZ(XComponent=0, YComponent=0, ZComponent=0)
move = Move(Geometry=polygon_2.Polygon, Motion=Z_2)  # -> Geometry, Transform
c_script = CSharpScript(depth=number_slider)  # -> out, segments, modules; inputs depth: Int32
# ---------- c_script: C# ----------
    int segmentsMade = (int) (Math.Pow(4, depth) - 1);
    int moduleCount = (int) Math.Sqrt(segmentsMade);

    segments = segmentsMade;
    modules = moduleCount;
# ---------- end c_script ----------
random = Random(Range=dom, Number=lng, Seed=2)
graph = GraphMapper(range, x0=0, x1=1, y0=0, y1=1, container_name="Sine", Equation_px=[0, 1], Equation_py=[0, 1])  # disabled
line = LineSDL(Start=pt, Direction=vrot, Length=number_slider_3)
Z_3 = UnitZ(Factor=random)
number_slider_4 = Slider(71, range=0..100)
slider = Slider(1.3, range=-2..2)
box_2 = DomainBox(Base=PlaneXY(0, 0, 0), X=dom_2, Y=dom_2, Z=dom_2)
X = UnitX(Factor=_90_0_90)
cp = ControlPoints(Curve=move.Geometry)  # -> Points, Weights, Knots
c_hilbert_simple = CSharpScript(
    begin=Toggle(True),
    depth=number_slider,
    dx=Slider(3.1, range=0.5..10),
    dy=Slider(-0.1, range=-10..10),
    zSteps=Slider(7, range=1..10),
    zRot=Slider(69, range=-90..90),
    z=z,
    spiral=Toggle(True))  # -> out, listCount, HilbertList, graft(HilbertStair), HSPts, HSCurve; inputs begin: Boolean, depth: Int32, dx: Double, dy: Double, zSteps: Int32, zRot: Int32, z: Double, spiral: Boolean
# ---------- c_hilbert_simple: C# ----------
    // by The Lord of Darkness due to a crisis of Tequila starvation (maybe Vodka is the solution?)
    // Includes the usual challenge with lot's of sardines for the brave winner > hurry!!

    // BTW: I hate computers, .NET, meshes, any Toyota, Gin Tonic and idiots
    
    if(begin){
      lines.Clear();
      LastX = 0; LastY = 0;
      Hilbert(lines, depth, dx, dy, ref lines);
      HilbertList = lines;
      listCount = lines.Count;
    }

    int segmentsMade = (int) (Math.Pow(4, depth) - 1);
    int moduleCount = (int) Math.Sqrt(segmentsMade);
    double size = moduleCount * dx;

    DataTree<Line> HStair = new DataTree<Line>();
    List<Point3d> HStairSpiralPts = new List<Point3d>();

    HStair.AddRange(lines, new GH_Path(0, 1));
    for(int i = 1;i <= zSteps;i++){

      Point3d pFirst = HStair.Branch(i - 1, 1)[0].From;
      if(i == 1)HStairSpiralPts.Add(pFirst);
      Point3d pLast = HStair.Branch(i - 1, 1)[segmentsMade - 1].To; Point3d pLastUP = new Point3d (pLast.X, pLast.Y, pLast.Z + z);
      HStairSpiralPts.Add(pLastUP);
      Plane pFrom = new Plane (pFirst, Plane.WorldXY.ZAxis);
      Plane pTo = new Plane (pLast + new Point3d(0, 0, z), Plane.WorldXY.ZAxis);
      double rotate = zRot;
      if(spiral) rotate = zRot * i;
      Transform rot = Transform.Rotation(RhinoMath.ToRadians(rotate), Plane.WorldXY.ZAxis, pLast);
      pTo.Transform(rot);
      Transform pTop = Transform.PlaneToPlane(pFrom, pTo);

      HStair.Add(new Line(pLast, pLastUP), new GH_Path(i, 0));

      List<Line> tmp = HStair.Branch(i - 1, 1).ToList();
      for(int j = 0; j < tmp.Count;j++){
        Line line = new Line();line = tmp[j];
        line.Transform(pTop);
        HStair.Add(line, new GH_Path(i, 1));
      }
    }

    HilbertStair = HStair;
    HSPts = HStairSpiralPts;

    Curve HCurv = Curve.CreateInterpolatedCurve(HStairSpiralPts, 3);
    HSCurve = HCurv;
    //BoundingBox box = new BoundingBox(new Point3d(0, 0, 0), new Point3d(size, size, size));
    //Box = box;
# ---------- c_hilbert_simple: C# additional code ----------
  private List<Line> lines = new List<Line> ();

  // well ...friends that's what we call recursion: Hilbert calls Hilbert ..
  //             ...who calls Hilbert (who finally gives up and calls Maria)

  private void Hilbert(List<Line> HL, int depth, double dx, double dy, ref List<Line> HLout)
  {
    if (depth > 1) Hilbert(HL, depth - 1, dy, dx, ref HL);
    DrawRelative(HL, dx, dy);
    if (depth > 1) Hilbert(HL, depth - 1, dx, dy, ref HL);
    DrawRelative(HL, dy, dx);
    if (depth > 1) Hilbert(HL, depth - 1, dx, dy, ref HL);
    DrawRelative(HL, -dx, -dy);
    if (depth > 1) Hilbert(HL, depth - 1, -dy, -dx, ref HL);
    HLout = HL;
  }

  private double LastX, LastY;

  // hint for the challenge: Maybe this?
  // Draw the line (LastX, LastY)-(LastX + dx, LastY + dy)
  // update LastX = LastX + dx, LastY = LastY + dy.

  private void DrawRelative(List<Line> HL, double dx, double dy)
  {
    HL.Add(new Line(new Point3d(LastX, LastY, 0), new Point3d(LastX + dx, LastY + dy, 0)));
    LastX = LastX + dx;
    LastY = LastY + dy;
  }
# ---------- end c_hilbert_simple ----------
move_2 = Move(Geometry=pts, Motion=Z_3)  # -> Geometry, Transform
range_2 = Range(Domain=Domain(0, 1.3), Steps=10)
move_3 = Move(Geometry=line, Translation=X)  # -> Geometry, Transform
panel = Panel("""0
0
6""")
c_script_2 = CSharpScript(b=box_2, rx=Slider(15, range=2..50), ry=Slider(15, range=2..50), rz=Slider(15, range=2..50))  # -> out, A; inputs b: Box, rx: Int32, ry: Int32, rz: Int32
# ---------- c_script_2: C# ----------
    double dx = 1.0 / (double) (rx - 1.0);
    double dy = 1.0 / (double) (ry - 1.0);
    double dz = 1.0 / (double) (rz - 1.0);

    int k = 0;
    int j = 0;
    int i = 0;

    List<double> d = new List<double>(rx * ry * rz);

    double dd = 0.0;
    double nx;
    double ny;
    double nz;
    double t;
    double v;

    double px;
    double py;
    double pz;

    double pi2 = Math.PI * 2.0;

    for(k = 0; k < rz;++k) {
      nz = k * dz;
      for(j = 0; j < ry;++j) {
        ny = j * dy;
        for(i = 0; i < rx;++i) {
          nx = i * dx;
          Point3d p = b.PointAt(nx, ny, nz);
          px = p.X;
          py = p.Y;
          pz = p.Z;


                    
          //Cube cube = New Cube

          *v = -2
          dd = Math.Sin * 2pi / dx
          dd = Math.Cos * 2pi / dy
          dd = v
          
          //dd = 0.1 * Math.Cos(pi2 * nx) * Math.Cos(2.0 * pi2 * (nz - ny)) - 0.1 * Math.Cos(pi2 * (3.0 * ny - 2.0 * nz)) + 0.2 * Math.Sin(2.0 * pi2 * (nz + ny));
          //Sherk surface
          //dd = Math.Exp(pz) * Math.Cos(px) - Math.Cos(py);
          //dd = pz * Math.Cos(px) - Math.Cos(py);
          //dd = pz * pz * Math.Cos(px) - Math.Cos(py);
          //Swartz P
          //dd = Math.Cos(px) + Math.Cos(py) + Math.Cos(pz);

          //Diamond
          /*dd = Math.Sin(px) * Math.Sin(py) * Math.Sin(pz) +
          Math.Sin(px) * Math.Cos(py) * Math.Cos(pz) +
          Math.Cos(px) * Math.Sin(py) * Math.Cos(pz) +
          Math.Cos(px) * Math.Cos(py) * Math.Sin(pz);*/

          //Tim Cube
          //t = py Math.Pow py -1;
          //(px Math.Pow px -1) * (pz Math.Pow(pz - 1));

          //Tim Sphere
          //ParametricPlot3D[{Cos[t] Cos[u], Sin[t] Cos[u], Sin[u]}, {t, 0,
          //2 Pi}, {u, -Pi / 2, Pi / 2}]

          //Tim Tube parametric {
          //function {sin(u)}
          //function {cos(u)}
          //function {v}
          //<0,-2 > <2 * pi,2 >

          //Barth's Sextic formula
          /*t = (1 + Math.Sqrt(5)) / 2;
          dd = 4 * (Math.Pow(t, 2) * Math.Pow(px, 2) - Math.Pow(py, 2)) * (Math.Pow(t, 2) * Math.Pow(py, 2) - Math.Pow(pz, 2)) * (Math.Pow(t, 2) * Math.Pow(pz, 2) - Math.Pow(px, 2)) -
          (1 + 2 * t) * (Math.Pow(px, 2) + Math.Pow(py, 2) + Math.Pow(pz, 2) - 1) * 2;


          //Gyroid
          /*dd = Math.Cos(px) * Math.Sin(py) +
          Math.Cos(py) * Math.Sin(pz) +
          Math.Cos(pz) * Math.Sin(px);*/

          //Neovius

          /*dd = 3.0 * (Math.Cos(px) + Math.Cos(py) + Math.Cos(pz)) +
          4.0 * (Math.Cos(px) * Math.Cos(py) * Math.Cos(pz));*/

          //Math.Cos(px) * Math.Cos(py) - Math.Cos(pz) * Math.Cos(py)

          d.Add(dd);
        }
      }
    }

    A = d;
# ---------- end c_script_2 ----------
avr = Average(Input=cp.Points)  # -> flatten(ArithmeticMean)
modules_at_x_y = Panel(c_script.modules)
more_is_less = Panel(c_script.segments)
end = EndPoints(Curve=line)  # -> Start, End
end_2 = EndPoints(Curve=move_3.Geometry)  # -> Start, End
more_is_less_2 = Panel(c_hilbert_simple.listCount)
series_2 = Series(Start=0, Step=number_slider_4, Count=10)
Y_2 = UnitY(Factor=number_slider_4)
box_3 = CenterBox(Base=move_2.Geometry, X=1, Y=1, Z=1)
toggle = BooleanToggle(True)
ln = Line(PointA=end.Start, PointB=end_2.Start)
ln_2 = Line(PointA=end.End, PointB=end_2.End)
scale_nu = ScaleNU(Geometry=move.Geometry, Plane=avr, ScaleX=1, ScaleY=1, ScaleZ=1)  # -> Geometry, Transform
path = DataPath()
path_2 = ConstructPath(Indices=panel)
preview = CustomPreview(Geometry=c_hilbert_simple.HilbertStair, Shader=ColourSwatch(SwatchColor=RGB(255, 255, 255)))
preview_2 = CustomPreview(Geometry=c_hilbert_simple.HSCurve, Shader=ColourSwatch(SwatchColor=RGB(0, 0, 255)))
X_2 = UnitX(Factor=series_2)
series_3 = Series(Start=0, Step=1, Count=10)
partition = PartitionList(List=box_3, Size=extent_y)
geo = Geometry()
geo_2 = Geometry([<brep referenced from the Rhino model> x2])
geo_3 = Geometry()
Z_4 = UnitZ(Factor=Slider(-21000, range=-21000..21000))
merge = Merge(Data1=ln, Data2=ln_2, Data3=line, Data4=move_3.Geometry)
branch = TreeBranch(Tree=partition, Path=path_2, MaintainPaths=True)
preview_3 = CustomPreview(Shader=ColourSwatch(SwatchColor=RGB(166, 166, 166)))
line_2 = Line(Line((133.1973546, 0, 19.94556265), (139.4341262, 3.31615029, 19.94556265)))
viewer_2 = ParamViewer(box_3)  # disabled
arrrec_2 = RectangularArray(
    Geometry=merge,
    Cell={Plane=PlaneXY(0, 0, 0), Size=Domain2(u=0..10, v=0..5)},
    XCount=Slider(10, range=0..10),
    YCount=Slider(10, range=0..10))  # -> Geometry, Transform
slider_2 = Slider(11, range=2..16)
division = Division(B=pi)
rotax = RotateAxis(Geometry=arrrec_2.Geometry, Angle=Slider(4, range=0..10), Axis=line_2)  # -> Geometry, Transform
num = Number(0.5)
multiplication = Multiplication(A=division, B=num)
slider_3 = Slider(0.25, range=0..1)
slider_4 = Slider(5, range=-1..5)
scale = Scale(Center=Point(0, 0, 0), Factor=multiplication)  # -> Geometry, Transform
lng_2 = ListLength()
division_2 = Division(A=Slider(4.21, range=0..12))
dom_3 = Domain(DomainStart=expr("x-1", lng_2), DomainEnd=0)
bnd = Bounds()
pt_2 = PointXYZ(XComponent=0, YComponent=0, ZComponent=0, System=PlaneXY(0, 0, 0))
remap = RemapNumbers(Source=bnd, Target=dom_3)
round = Round(Number=remap)  # -> Nearest, Floor, Ceiling
vec2pt = Vector2Pt(PointA=pt_2, Unitize=False)  # -> Vector, Length
item = ListItem(List=scale.Geometry, Index=round.Nearest, Wrap=False)
move_4 = Move(Geometry=item, Motion=vec2pt.Vector)  # -> Geometry, Transform
preview_4 = CustomPreview(Geometry=move_4.Geometry, Shader=ColourSwatch(SwatchColor=RGB(186, 186, 186)))
