# Grasshopper definition flatten tutorial.gh (Grasshopper 1.0.7)

brep = Brep([<brep referenced from the Rhino model> x4])
panel = Panel(brep)
debrep = DeconstructBrep(Brep=brep)  # -> simplify(Faces), Edges, Vertices
item = ListItem(List=debrep.Faces, Index=Slider(1, range=0..10), Wrap=True)
crv = Curve(item)
flatten = FlattenTree(Tree=crv, Path="{0}")
simplify = SimplifyTree(Front=False)
loft = Loft(Curves=flatten, Options={Adjust=False, Closed=False, LoftEnds=0, LoftSimp=0, LoftType=0, Rebuild=10, Refit=0.01})
panel_2 = Panel(crv)
intcrv = Interpolate(Degree=3, Periodic=invert(False), KnotStyle=1)  # -> Curve, Length, Domain
