# Grasshopper definition masterworkFara.gh (Grasshopper 1.0.7)

# ---- group: Petal
md_slider = MDSlider(
    SliderMode=0,
    slider_value=Point(0.387986346, 0.4973336197, 0.5),
    x_domain=Domain(0, 1),
    y_domain=Domain(0, 1),
    z_domain=Domain(0, 1))
multiplication = Multiplication(A=md_slider, B=Slider(10, range=0..10))
rec_2pt = Rectangle2Pt(Plane=PlaneXY(0, 0, 0), PointA=Point(0, 0, 0), PointB=multiplication, Radius=0)  # -> Rectangle, Length
panel = Panel("""3
1""")
panel_2 = Panel("""0
2""")
explode = Explode(Curve=rec_2pt.Rectangle, Recursive=True)  # -> Segments, Vertices
item = ListItem(List=explode.Vertices, Index=panel, Wrap=True)
item_2 = ListItem(List=explode.Vertices, Index=panel_2, Wrap=True)
ln = Line(StartPoint=item, EndPoint=item_2)
Z = UnitZ(Factor=1)
vec = Vector(ln)
curvepoint = PointOnCurve(ln, parameter=0)
xprod = CrossProduct(VectorA=vec, VectorB=Z, Unitize=False)  # -> Vector, Length
multiplication_2 = Multiplication(A=xprod.Vector, B=Slider(0.271, range=0..10))
move = Move(Geometry=curvepoint, Motion=multiplication_2)  # -> Geometry, Transform
pt = Point([move.Geometry, explode.Vertices])
hull = ConvexHull(Points=pt, Plane=PlaneXY(0, 0, 0))  # -> Hull, HullZ, Indices

# ----
number_slider = Slider(5, range=0..10)
pi = Pi(Factor=1)
division = Division(A=pi, B=number_slider)
series = Series(Start=0, Step=division, Count=number_slider)
panel_3 = Panel(series)
pcen = PolygonCenter(Polyline=hull.Hull)  # -> CenterV, CenterE, CenterA
xy = XYPlane(Origin=pcen.CenterV)
rotate = Rotate(Geometry=hull.Hull, Angle=series, Plane=xy)  # -> Geometry, Transform
pln = Plane(Plane(origin=(6.56046162, 3.868646649, 0), x=(0.08304547985, -0.9965457582, 0), y=(0.9965457582, 0.08304547985, 0)))
Z_2 = UnitZ(Factor=Slider(4.034, range=0..10))
extr = Extrude(Base=rotate.Geometry, Direction=Z_2)
arrpolar = PolarArray(Geometry=rotate.Geometry, Plane=pln, Count=Slider(5, range=0..10), Angle=6.283185307)  # -> Geometry, Transform
extr_2 = Extrude(Base=arrpolar.Geometry, Direction=Z_2)
