# Grasshopper definition practice1.gh (Grasshopper 1.0.7)
# plug-ins: Bifocals

polygon = Polygon(Plane=PlaneXY(0, 0, 0), Radius=3, Segments=Slider(4, range=0..10), FilletRadius=0)  # -> Polygon, Length
series = Series(Start=0, Step=Slider(7, range=0..10), Count=Slider(15, range=0..100))
unit_x = UnitX(Factor=series)
move = Move(Geometry=polygon.Polygon, Motion=unit_x)  # -> Geometry, Transform
unit_y = UnitY(Factor=series)
cross_reference = CrossReference(ListA=move.Geometry, ListB=unit_y, CrossMode=1)  # -> ListA, ListB
move_2 = Move(Geometry=cross_reference.ListA, Motion=cross_reference.ListB)  # -> Geometry, Transform
area = Area(Geometry=move_2.Geometry)  # -> Area, Centroid
curve = Curve(<curve referenced from the Rhino model>)
curve_closest_point = CurveClosestPoint(Point=area.Centroid, Curve=curve)  # -> Point, Parameter, Distance
bounds = Bounds(Numbers=curve_closest_point.Distance)
construct_domain = ConstructDomain(DomainStart=Slider(0.008, range=0..0.01), DomainEnd=Slider(1.2, range=0..10))
remap_numbers = RemapNumbers(Value=bounds, Source=bounds, Target=construct_domain)  # -> Mapped, Clipped
scale = Scale(Geometry=move_2.Geometry, Center=area.Centroid, Factor=remap_numbers.Mapped)  # -> Geometry, Transform
multiplication = Multiplication(A=remap_numbers.Mapped, B=Slider(36, range=0..100))
unit_z = UnitZ(Factor=multiplication)
