# Grasshopper definition voronoi warped tower.gh (Grasshopper 1.0.7)
# plug-ins: Weaverbird

number_slider = Slider(60, range=0..100)
rectangle = Rectangle(Plane=PlaneXY(0, 0, 0), XSize=Slider(16, range=0..100), YSize=Slider(20, range=0..100), Radius=0)  # -> Rectangle, Length
unit_z = UnitZ(Factor=number_slider)
area = Area(Geometry=rectangle.Rectangle)  # -> Area, Centroid
unit_z_2 = UnitZ(Factor=1)
move = Move(Geometry=rectangle.Rectangle, Motion=unit_z)  # -> Geometry, Transform
control_points = ControlPoints(Curve=rectangle.Rectangle)  # -> Points, Weights, Knots
control_points_2 = ControlPoints(Curve=move.Geometry)  # -> Points, Weights, Knots
list_item = ListItem(List=control_points.Points, Index=Slider(3, range=0..10), Wrap=True)
list_item_2 = ListItem(List=control_points_2.Points, Index=Slider(1, range=0..10), Wrap=True)
point = Point(list_item_2)
point_2 = Point(list_item)
line_sdl = LineSDL(Start=area.Centroid, Direction=unit_z_2, Length=number_slider)
box_2pt = Box2Pt(PointA=point_2, PointB=point, Plane=PlaneXY(0, 0, 0))
crv = Curve(<curve referenced from the Rhino model>)
box = Box({Plane=PlaneXY(-58.55472968, -79.16990348, 0), X=Domain(0, 180.7073421), Y=Domain(0, 65.4968742), Z=Domain(0, 47.97251223)})
populate_3d = Populate3D(Region=box, Count=Slider(140, range=0..1000), Seed=1)
voronoi_3d = Voronoi3D(Points=populate_3d, Box=box)  # -> Cells, Boundary
curve_closest_point = CurveClosestPoint(Point=populate_3d, Curve=crv)  # -> Point, Parameter, Distance
smaller_than = SmallerThan(FirstNumber=curve_closest_point.Distance, SecondNumber=Slider(26, range=0..100))  # -> SmallerThan, OrEqualTo
cull_pattern = CullPattern(List=voronoi_3d.Cells, CullPattern=smaller_than.SmallerThan)
solid_union = SolidUnion(Breps=cull_pattern)
mesh = Mesh(solid_union)
weaverbird_s_picture_frame = WeaverbirdsPictureFrame(MeshPolylines=mesh, Distance=Slider(5.4, range=0..10), InsetType=0)
weaverbird_s_mesh_thicken = WeaverbirdsMeshThicken(MeshCurves=weaverbird_s_picture_frame, Distance=Slider(0.048, range=0..0.1), OffsetType=0)
weaverbird_s_loop_subdivision = WeaverbirdsLoopSubdivision(MeshCurves=weaverbird_s_mesh_thicken, Level=1, SmoothNakedEdges=1)
