# Grasshopper definition walking warped tower.gh (Grasshopper 1.0.7)
# plug-ins: Bifocals, Weaverbird

number_slider = Slider(12, range=0..100)
curve = Curve([<curve referenced from the Rhino model> x2])
loft = Loft(Curves=curve, Options={Adjust=False, Closed=False, LoftEnds=0, LoftSimp=0, LoftType=0, Rebuild=10, Refit=0.01})
divide_curve = DivideCurve(Curve=curve, Count=number_slider, Kinks=False)  # -> Points, Tangents, Parameters
unit_z = UnitZ(Factor=Slider(0.15, range=0..1))
unit_z_2 = UnitZ(Factor=1)
explode_tree = ExplodeTree(Data=divide_curve.Points)  # -> Branch0, Branch1
arc_sed = ArcSED(Start=explode_tree.Branch0, End=explode_tree.Branch1, Direction=unit_z_2)  # -> Arc, Plane, Radius
extrude = Extrude(Base=loft, Direction=unit_z)
divide_curve_2 = DivideCurve(Curve=arc_sed.Arc, Count=number_slider, Kinks=False)  # -> Points, Tangents, Parameters
number_slider_2 = Slider(0.18, range=0..1)
flip_matrix = FlipMatrix(Data=divide_curve_2.Points)
interpolate = Interpolate(Vertices=flip_matrix, Degree=3, Periodic=False, KnotStyle=1)  # -> Curve, Length, Domain
pipe = Pipe(Curve=arc_sed.Arc, Radius=number_slider_2, Caps=0)
loft_2 = Loft(Curves=arc_sed.Arc, Options={Adjust=False, Closed=False, LoftEnds=0, LoftSimp=0, LoftType=0, Rebuild=10, Refit=0.01})
offset_surface = OffsetSurface(Surface=loft_2, Distance=number_slider_2, Retrim=True)
mesh_brep = MeshBrep(
    Brep=offset_surface,
    Settings={GridMaxCount=0, GridMinCount=16, JaggedSeams=False, MaxEdgeLength=0, MinEdgeLength=0.0001, MinTolerance=0, Refine=True, RefineAngle=0, RelativeTolerance=0.65, SimplePlanes=True, Tolerance=0})
curve_closest_point = CurveClosestPoint(Curve=curve)  # -> Point, Parameter, Distance
weaverbird_s_picture_frame = WeaverbirdsPictureFrame(MeshPolylines=mesh_brep, Distance=Slider(5, range=0..10), InsetType=0)
voronoi_3d = Voronoi3D()  # -> Cells, Boundary
bounds = Bounds(Numbers=curve_closest_point.Distance)
weaverbird_s_mesh_thicken = WeaverbirdsMeshThicken(MeshCurves=weaverbird_s_picture_frame, Distance=Slider(0.29, range=0..1), OffsetType=0)
weaverbird_s_loop_subdivision = WeaverbirdsLoopSubdivision(MeshCurves=weaverbird_s_mesh_thicken, Level=Slider(3, range=0..10), SmoothNakedEdges=1)
weaverbird_s_catmull_clark_subdivision = WeaverbirdsCatmullClarkSubdivision(MeshCurves=weaverbird_s_loop_subdivision, Level=1, SmoothNakedEdges=1)
